# Grasshopper definition crapperShellTest2_RhinoVault.gh (Grasshopper 1.0.7)
# plug-ins: K2Engineering, Weaverbird, Kangaroo2 Components, plankton, ggRhinoIFC

# Format Engineers CAD Information Issue Disclaimer
# 
# Project: PROJECT NAME
# 
# You should use this model for reference purposes only to assist in co-ordinating your work and is supplementary to formally issued drawings. Once the data is introduced into your own CAD or other system Format Engineers Ltd. can take no responsibility for its accuracy.
# 
# The last set of formally issued paper drawings are the contractual documents which represent the current stage of design development. If you have any queries, please contact the project CAD co-ordinator or the CAD Development Team.
# 
# Changes:
# 
# YYYY-MM-DD: Summary of changes
# 
# Usage notes:
# 
# This definition includes a basic implementation of Merbarki's Farthest Point Seeding algorithm (2005), adapted for tracing lines of principal curvature on NURBS surfaces. Requires modified Triangle.NET, if this isn't attached then... good luck! There are currently two main limitations: (a) this implementation measures density in parameter space, and (b) it doesn't include the dynamic refinement of density that Mebarki suggests.
gggrasshoppersettings = GgGrasshopperSettings(
    SettingsData_IFCSettings_Format="STEP",
    SettingsData_IFCSettings_GenerateOwnerHistory=True,
    SettingsData_IFCSettings_IdentifyObsolete=True,
    SettingsData_IFCSettings_LastUsedUnits="Meters",
    SettingsData_IFCSettings_Radians=True,
    SettingsData_IFCSettings_RepMapExport="NONE",
    SettingsData_IFCSettings_Target="Universal",
    SettingsData_IFCSettings_VersionIFC="IFC2x3",
    SettingsData_RevitSettings_Format="STEP",
    SettingsData_RevitSettings_GenerateOwnerHistory=True,
    SettingsData_RevitSettings_IdentifyObsolete=True,
    SettingsData_RevitSettings_LastUsedUnits="Meters",
    SettingsData_RevitSettings_Radians=True,
    SettingsData_RevitSettings_RepMapExport="NONE",
    SettingsData_RevitSettings_Target="Universal",
    SettingsData_RevitSettings_VersionIFC="IFC4")
crv = Curve([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])
crv_2 = Curve([<curve referenced from the Rhino model> x524])
wbweave = WeaverbirdsMeshFromLinesWeaveBack(Lines=crv_2, MaximumValence=4)
tri = Triangulate(Mesh=wbweave)  # -> Mesh, Count
pmesh = PlanktonMesh(tri.Mesh)
number_slider = Slider(6.052, range=0..10)
pt = Point([<point referenced from the Rhino model> x42])
anchor = Anchor(Point=pt, Strength=10000)
length_line = LengthLine(Line=crv, Length="0", Strength=Slider(16.884, range=0..20))
mvarea = MeshVertexArea(PlanktonMesh=pmesh)  # -> Vertices, VertexNormals
show = Show(G=crv)
neg = Negative(Value=Slider(5.8168, range=0..10))
multiplication = Multiplication(A=mvarea.VertexNormals, B=neg)
load = Load(Point=mvarea.Vertices, NodalForce=multiplication)
entwine = Entwine(Branch00=show, Branch01=length_line, Branch02=anchor, Branch03=load, FlattenInputs=True)
solver = Solver(GoalObjects=entwine, Reset=Button(), Threshold=1e-15, Tolerance=0.01, On=Toggle(True))  # -> I, V, O
crv_3 = Curve(solver.O)
wbweave_2 = WeaverbirdsMeshFromLinesWeaveBack(Lines=crv, MaximumValence=4)
bang = ExplodeTree(Data=crv_3)  # -> Branch0, Branch1
clean = CleanTree(RemoveNulls=True, RemoveInvalid=True, RemoveEmpty=False, Tree=flatten(bang.Branch0))  # -> flatten(Tree)
wbweave_3 = WeaverbirdsMeshFromLinesWeaveBack(Lines=clean, MaximumValence=4)
clean_2 = CombineClean(Meshes=wbweave_3)
mesh = Mesh(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)
