# Grasshopper definition GrasshopperScriptTest.gh (Grasshopper 1.0.7)
# plug-ins: MeshEdit Components, Kangaroo Components, Alpaca4d, LunchBox, Weaverbird, Kangaroo2 Components, TetgenGH

brep = Brep(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)
mesh = MeshBrep(
    Brep=brep,
    Settings={GridMaxCount=0, GridMinCount=16, JaggedSeams=False, MaxEdgeLength=0, MinEdgeLength=0.0001, MinTolerance=0, Refine=True, RefineAngle=0, RelativeTolerance=0, SimplePlanes=True, Tolerance=0})
tetgen = Tetrahedralize(Mesh=mesh, Flags=Slider(0, range=0..10), MinRatio=Slider(1.3, range=0..10))  # -> Mesh, Indices, Points
deconstruct_mesh = DeconstructMesh(Mesh=tetgen.Mesh)  # -> Vertices, Faces, Colours, Normals
removeduplicatepts = RemoveDuplicatePts(Points=flatten(deconstruct_mesh.Vertices), Tolerance=0.01)
pdecon = Deconstruct(Point=removeduplicatepts)  # -> XComponent, YComponent, ZComponent
pdecon_2 = Deconstruct(Point=removeduplicatepts)  # -> XComponent, YComponent, ZComponent
larger_than = LargerThan(FirstNumber=pdecon.XComponent, SecondNumber="25")  # -> LargerThan, OrEqualTo
smaller = SmallerThan(FirstNumber=pdecon_2.XComponent, SecondNumber="0.1")  # -> SmallerThan, OrEqualTo
cull = CullPattern(List=removeduplicatepts, CullPattern=smaller.SmallerThan)  # -> graft(List)
cull_2 = CullPattern(List=removeduplicatepts, CullPattern=larger_than.LargerThan)  # -> graft(List)
point = Point(cull)
point_2 = Point(cull_2)
support = Point(point)
pointload = Point(point_2)
vec = VectorXYZ(XComponent=0, YComponent=0, ZComponent="-100")  # -> Vector, Length
entwine = Entwine(Branch03=support, Branch04=pointload, Branch05=vec.Vector, Branch012=graft(tetgen.Mesh), FlattenInputs=True)

number_slider = Slider(5, range=0..100)

# ---- group: Element
data = Data(0)
data_2 = Data(0)

# ---- group: Load
data_3 = Data(0)
data_4 = Data(0)

# ---- group: Cross-Section
data_5 = Data(0)
data_6 = Data(0)

# ---- group: Support
data_7 = Data(0)
data_8 = Data(0)

# ----
# Model 4
number_slider_2 = Slider(60, range=0..100)
construct_point = ConstructPoint(XCoordinate=0, YCoordinate=0, ZCoordinate=0)
construct_point_2 = ConstructPoint(XCoordinate=number_slider_2, YCoordinate=0, ZCoordinate=0)
unit_z = UnitZ(Factor=Slider(10, range=0..10))
line = Line(StartPoint=construct_point, EndPoint=construct_point_2)
move = Move(Geometry=line, Motion=unit_z)  # -> Geometry, Transform
panel = Panel(number_slider_2)
_2d_truss = _2DTruss(CurveA=line, CurveB=move.Geometry, Divisions=Slider(5, range=0..10), TrussToggle=0)  # -> PrimaryLines, BraceLines, VerticalLines, StructureNodes
pdecon_3 = Deconstruct(Point=_2d_truss.StructureNodes)  # -> XComponent, YComponent, ZComponent
pdecon_4 = Deconstruct(Point=_2d_truss.StructureNodes)  # -> XComponent, YComponent, ZComponent
equality = Equality(FirstNumber=pdecon_4.XComponent, SecondNumber=panel)  # -> Equality, Inequality
smaller_2 = SmallerThan(FirstNumber=pdecon_3.XComponent, SecondNumber="0.1")  # -> SmallerThan, OrEqualTo
merge = Merge(Data1=_2d_truss.PrimaryLines, Data2=_2d_truss.BraceLines, Data3=_2d_truss.VerticalLines)
cull_3 = CullPattern(List=_2d_truss.StructureNodes, CullPattern=equality.Equality)  # -> flatten(List)
cull_4 = CullPattern(List=_2d_truss.StructureNodes, CullPattern=smaller_2.SmallerThan)  # -> flatten(List)
vec_2 = VectorXYZ(XComponent=0, YComponent=0, ZComponent="-100")  # -> Vector, Length
pointload_2 = Point(cull_3)
support_2 = Point(cull_4)
beam = Curve(merge)
entwine_2 = Entwine(Branch01=beam, Branch03=support_2, Branch04=pointload_2, Branch05=vec_2.Vector, FlattenInputs=True)

series = Series(Start="0", Step="0.50", Count="2")

# ---- group: Material
data_9 = Data(0)
data_10 = Data(0)

# ---- group: Constraint
data_11 = Data(0)
data_12 = Data(0)

# ----
curve = Curve([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])

# ----
# Model 2
number_slider_3 = Slider(6, range=0..10)
vector_xyz = VectorXYZ(XComponent=0, YComponent=0, ZComponent=0)  # -> Vector, Length
vector_xyz_2 = VectorXYZ(XComponent=0, YComponent=0, ZComponent=number_slider_3)  # -> Vector, Length
move_2 = Move(Geometry=vector_xyz.Vector, Motion=vector_xyz_2.Vector)  # -> Geometry, Transform
line_2 = Line(StartPoint=vector_xyz.Vector, EndPoint=move_2.Geometry)
num = Number("0")
pointload_3 = Point(move_2.Geometry)
vec_3 = VectorXYZ(XComponent=0, YComponent=Slider(6, range=-20..20), ZComponent=0)  # -> Vector, Length
pointload_4 = Point(move_2.Geometry)
vec_4 = VectorXYZ(XComponent=Slider(0, range=-20..20), YComponent=0, ZComponent=0)  # -> Vector, Length
support_3 = Point(vector_xyz.Vector)
beam_2 = Curve(line_2)
columns = Curve(beam_2)
entwine_3 = Entwine(
    Branch01=beam_2,
    Branch03=support_3,
    Branch04=pointload_4,
    Branch05=vec_3.Vector,
    Branch06=columns,
    Branch07=vec_4.Vector,
    Branch010=pointload_3,
    Branch011=num,
    FlattenInputs=True)

# ----
# Model 1
number_slider_4 = Slider(10, range=0..40)
number_slider_5 = Slider(20, range=0..40)
mesh_plane = MeshPlane(
    Boundary={Plane=PlaneXY(0, 0, 0), Size=Domain2(u=-10..10, v=-10..10)},
    WidthCount=number_slider_4,
    HeightCount=number_slider_4)  # -> Mesh, Area
shell = Mesh(mesh_plane.Mesh)
clean = CombineClean(Meshes=shell)
explode = MeshExplode(Mesh=clean, Interpolate=False)  # -> flatten(Faces)
demesh = DeconstructMesh(Mesh=clean)  # -> Vertices, Faces, Colours, Normals
area = Area(Geometry=mesh_plane.Mesh)  # -> Area, Centroid
area_2 = Area(Geometry=explode)  # -> Area, Centroid
distance = Distance(PointA=area.Centroid, PointB=area_2.Centroid)
bounds = Bounds(Numbers=distance)
nakedvertices = NakedVertices(Mesh=mesh_plane.Mesh)  # -> ClothedIndex, NakedIndex, ClothedPts, NakedPts
difference = SetDifference(SetA=demesh.Vertices, SetB=nakedvertices.NakedPts)
mc = MeshCorners(Mesh=clean, Angle=2.35619449)
deconstruct_domain = DeconstructDomain(Domain=bounds)  # -> Start, End
vec_5 = VectorXYZ(XComponent=Slider(17, range=-20..20), YComponent=Slider(20, range=-20..20), ZComponent=Slider(-100, range=-100..20))  # -> Vector, Length
maximum = Maximum(A=deconstruct_domain.Start, B=deconstruct_domain.End)
pointload_5 = Point(difference)
support_4 = Point(nakedvertices.NakedPts)
similarity = Similarity(FirstNumber=distance, SecondNumber=maximum, Threshold=Slider(1e-06, range=0..1e-06))  # -> Similarity, AbsoluteDifference
dispatch = Dispatch(List=explode, DispatchPattern=similarity.Similarity)  # -> ListA, ListB
entwine_4 = Entwine(Branch00=explode, Branch03=support_4, Branch04=pointload_5, Branch05=vec_5.Vector, FlattenInputs=True)

explode_2 = Explode(Curve=curve, Recursive=True)  # -> Segments, Vertices
unit_z_2 = UnitZ(Factor=series)
triangulate = Triangulate(Mesh=shell)  # -> Mesh, Count
removeduplicatepts_2 = RemoveDuplicatePts(Points=flatten(explode_2.Vertices), Tolerance=0.01)
refine = Refine(Mesh=triangulate.Mesh, Level="0")
construct_domain = ConstructDomain(DomainStart=Slider(1, range=0..1), DomainEnd=Slider(8, range=0..10))
deconstruct = Deconstruct(Point=removeduplicatepts_2)  # -> XComponent, YComponent, ZComponent
vec_6 = VectorXYZ(XComponent=Slider(11, range=-20..20), YComponent=Slider(11, range=-20..20), ZComponent=0)  # -> Vector, Length
panel_2 = Panel("0.50")
smaller_than = SmallerThan(FirstNumber=deconstruct.ZComponent, SecondNumber="1")  # -> SmallerThan, OrEqualTo
series_2 = Series(Start="0", Step="0.50", Count=Slider(3, range=0..10))
list = ValueList({"Building": 0, "Shell": 1, "Cantiliver": 2, "Brick esaedro": 3, "Truss": 4, "telaio": 5, "Brick tetraedro": 6, "Building  2": 7}, selected="Building")
construct_domain_2 = ConstructDomain(DomainStart=Slider(1, range=0..1), DomainEnd=Slider(8, range=0..10))
dispatch_2 = Dispatch(List=removeduplicatepts_2, DispatchPattern=smaller_than.SmallerThan)  # -> ListA, ListB
unit_z_3 = UnitZ(Factor=series_2)
vec_7 = VectorXYZ(XComponent=Slider(11, range=-20..20), YComponent=Slider(11, range=-20..20), ZComponent=0)  # -> Vector, Length
addition = Addition(A="25", B=Slider(30, range=0..100))
vector_xyz_3 = VectorXYZ(XComponent=addition, YComponent=Slider(30, range=0..100), ZComponent=Slider(43, range=0..100))  # -> Vector, Length
point_3 = Point(vector_xyz_3.Vector)
line_3 = Line(StartPoint=cull_2, EndPoint=point_3)
item_index = ItemIndex(List=explode, Item=dispatch.ListA)
mesh_2 = Mesh(dispatch.ListA)

# ----
# UniaxialMaterial
# Elastic
file_path = FilePath("C:\GitHub\Alpaca4d\PythonScript\Pre-Processing\Material\uniAxialMaterial\ElasticUniaxialMaterial.py")
read_file = ReadFile(File=file_path, PerLineParse=False)
python = GhPythonScript(Code=read_file, MatName="S275", E="210000", G="80760", Rho="75", Fy="35")  # -> Out, UniaxialMaterial
python_2 = GhPythonScript(x=python.UniaxialMaterial)  # -> out, a
# ---------- python_2: Python ----------
a = x
# ---------- end python_2 ----------
panel_3 = Panel(python_2.a)

# ----
# UniaxialMaterial
# Elastic
panel_4 = Panel("210000")
python_3 = GhPythonScript(Code=read_file, MatName="S255", E=panel_4, G="80760", Rho="75", Fy="25")  # -> Out, UniaxialMaterial
python_4 = GhPythonScript(x=python_3.UniaxialMaterial)  # -> out, a; same code as python_2
panel_5 = Panel(python_4.a)

# ----
# nDMaterial
# ElasticIsotropic
file_path_2 = FilePath("C:\GitHub\Alpaca4d\PythonScript\Pre-Processing\Material\nDMaterial\ElasticIsotropic.py")
read_file_2 = ReadFile(File=file_path_2, PerLineParse=False)
python_5 = GhPythonScript(Code=read_file_2, MatName="S275", E="210000", G="80760", Rho="75", Fy="35")  # -> Out, NDMaterial

# ----
# Generic Cross Section
file_path_3 = FilePath("C:\GitHub\Alpaca4d\PythonScript\Pre-Processing\Section\GenericCrossSection.py")
read_file_3 = ReadFile(File=file_path_3, PerLineParse=False)
python_6 = GhPythonScript(
    Code=read_file_3,
    SectionName="Generic",
    Area="20",
    Ay="20",
    Az="20",
    Iyy="20",
    Izz="20",
    J="20",
    UniaxialMaterial=python.UniaxialMaterial)  # -> Out, CrossSection

file_path_4 = FilePath("C:\GitHub\Alpaca4d\PythonScript\Pre-Processing\Load\BeamLoad.py")

# ----
# WIP
panel_6 = Panel("100")
random = Random(Range="20", Number=panel_6, Seed=2)
random_2 = Random(Range="20", Number=panel_6, Seed="3")
pt = ConstructPoint(XCoordinate=random, YCoordinate=random_2, ZCoordinate=0)
python_7 = GhPythonScript(Pos=pt, RigidDiaphragm=Toggle(True))  # -> Out, A

# ----
# Circular CrossSection
file_path_5 = FilePath("C:\GitHub\Alpaca4d\PythonScript\Pre-Processing\Section\CircularCrossSection.py")
read_file_4 = ReadFile(File=file_path_5, PerLineParse=False)
python_8 = GhPythonScript(Code=read_file_4, SectionName="CHS", Diameter="400", Thickness="40", UniaxialMaterial=python_3.UniaxialMaterial)  # -> Out, CrossSection

read_file_5 = ReadFile(File=file_path_4, PerLineParse=False)

# ----
# Rectangular Cross Section
file_path_6 = FilePath("C:\GitHub\Alpaca4d\PythonScript\Pre-Processing\Section\RectangularCrossSection.py")
read_file_6 = ReadFile(File=file_path_6, PerLineParse=False)
python_9 = GhPythonScript(Code=read_file_6, SectionName="RHS", Base="300", Height="300", UniaxialMaterial=python.UniaxialMaterial)  # -> Out, CrossSection

# ----
# Elastic Membrane Plate Section
file_path_7 = FilePath("C:\GitHub\Alpaca4d\PythonScript\Pre-Processing\Section\ElasticMembranePlateSection.py")
read_file_7 = ReadFile(File=file_path_7, PerLineParse=False)
python_10 = GhPythonScript(Code=read_file_7, SectionName="concreteSlab", Thickness="250", NDMaterial=python_5.NDMaterial)  # -> Out, CrossSection

int = Integer(Toggle(False))
panel_7 = Panel(int)
python_11 = GhPythonScript(Force=Point(0, 0, 0), Moment=Point(0, 0, 0))  # -> flatten(LoadWrapper); inputs Force: Vector3d, Moment: Vector3d, Pos: Point3d
# ---------- python_11: Python ----------
"""Generate a point load.
    Inputs:
        Force: Input force vector [kN].
        Moment: Input moment vector [kN].
        Pos: Point to apply the loads.
    Output:
       LoadWrapper: Load element.
       """


from ghpythonlib.componentbase import executingcomponent as component
import Grasshopper, GhPython
import System
import Rhino
import rhinoscriptsyntax as rs

class MyComponent(component):
    
    def RunScript(self, Force, Moment, Pos):
        
        import Rhino.Geometry as rg
        import Grasshopper as gh
        
        def pointLoad(Force, Moment, Pos):
        
            Pos = Pos
            Force = rg.Vector3d(0,0,0) if Force is None else Force                   # Input value in kN ---> Output kN
            Moment = rg.Vector3d(0,0,0) if Moment is None else Moment                 # Input value in kNm ---> Output kNm
            loadType = "pointLoad"
        
            return [[Pos, Force, Moment, loadType]]
        
        checkData = True
        
        if Force is None:
            checkData = False
            msg = "input 'Force' failed to collect data"
            ghenv.Component.AddRuntimeMessage(gh.Kernel.GH_RuntimeMessageLevel.Warning, msg)
        
        if Moment is None:
            checkData = False
            msg = "input 'Moment' failed to collect data"
            ghenv.Component.AddRuntimeMessage(gh.Kernel.GH_RuntimeMessageLevel.Warning, msg)
        
        if Pos is None:
            checkData = False
            msg = "input 'Pos' failed to collect data"
            ghenv.Component.AddRuntimeMessage(gh.Kernel.GH_RuntimeMessageLevel.Warning, msg)
        
        
        if checkData != False:
            LoadWrapper = pointLoad(Force, Moment, Pos)
            return LoadWrapper
# ---------- end python_11 ----------
file_path_8 = FilePath("C:\GitHub\Alpaca4d\PythonScript\Pre-Processing\Element\Brick\BbarBrick.py")
read_file_8 = ReadFile(File=file_path_8, PerLineParse=False)

# ---- group: Rectangular Hollow Cross Section
file_path_9 = FilePath("C:\GitHub\Alpaca4d\PythonScript\Pre-Processing\Section\RectangularHollowCrossSection.py")
read_file_9 = ReadFile(File=file_path_9, PerLineParse=False)
python_12 = GhPythonScript(Code=read_file_9, SectionName="RHS", Base="300", Height="300", Thickness="25", UniaxialMaterial=python.UniaxialMaterial)  # -> Out, CrossSection

# ----
# doubleT CrossSection
file_path_10 = FilePath("C:\GitHub\Alpaca4d\PythonScript\Pre-Processing\Section\doubleTCrossSection.py")
read_file_10 = ReadFile(File=file_path_10, PerLineParse=False)
python_13 = GhPythonScript(
    Code=read_file_10,
    SectionName="TT",
    Bsup="300",
    Binf="600",
    H="500",
    Tsup="100",
    Tinf="100",
    Tw="100",
    UniaxialMaterial=python_3.UniaxialMaterial)  # -> Out, CrossSection

number_slider_6 = Slider(0.1, range=0..0.1)  # disabled
panel_8 = Panel("21")  # disabled
panel_9 = Panel("5")  # disabled
range = Range(Domain=Domain(0, 1), Steps=10)  # disabled
series_3 = Series(Start=0, Step=number_slider_6, Count=panel_8)  # disabled
panel_10 = Panel("1")  # disabled
panel_11 = Panel("0.01")  # disabled
panel_12 = Panel("3")  # disabled
panel_13 = Panel("0")  # disabled
pi = Pi(Factor=panel_12)  # disabled
panel_14 = Panel("200")  # disabled
panel_15 = Panel("0")  # disabled
number_slider_7 = Slider(20, range=0..100)  # disabled
construct_domain_3 = ConstructDomain(DomainStart=panel_13, DomainEnd=pi)  # disabled
path = FilePath("C:\GitHub\Alpaca4d\PythonScript\Analyses\LinearAnalyses\initializeAnalysis.py")
number_slider_8 = Slider(20, range=0..100)  # disabled
construct_domain_4 = ConstructDomain(DomainStart=panel_15, DomainEnd=panel_14)  # disabled
# solver on folder Static Analyses 3ndf
# solver on folder Static Analyses
path_2 = FilePath("C:\GitHub\Alpaca4d\PythonScript\Analyses\openSees_StaticSolver_3ndf\initializeAnalysis_3ndf.py")  # disabled
toggle = BooleanToggle(False)
panel_16 = Panel(path)
# solver on folder Static Analyses
file = ReadFile(File=path, PerLineParse=False)
file_2 = ReadFile(File=path_2, PerLineParse=False)  # disabled
range_2 = Range(Domain=construct_domain_3, Steps=number_slider_7)  # disabled
analyze = GhPythonScript()  # -> AlpacaStaticOutput; inputs AlpacaModel: list; disabled
# ---------- analyze: Python ----------
"""Calculate the Static Response of the structure
    Inputs:
        AlpacaModel: Assemble model to perform Static Analyses.
    Output:
       AlpacaStaticOutput: Analysed Alpaca model.
       maxDisplacement: Maximum displacement of structure [mm].
       """


from ghpythonlib.componentbase import executingcomponent as component
import Grasshopper, GhPython
import System
import Rhino
import rhinoscriptsyntax as rs

class MyComponent(component):
    
    def RunScript(self, AlpacaModel):
        
        
        import System
        import os
        import Grasshopper as gh
        
        def InitializeStaticAnalysis(AlpacaModel):
            
            ghFilePath = ghenv.Component.Attributes.Owner.OnPingDocument().FilePath
            workingDirectory = os.path.dirname(ghFilePath) 
            outputFileName = 'openSeesOutputWrapper.txt'
        
            for dirpath, dirnames, filenames in os.walk(workingDirectory):
                for filename in filenames:
                    if filename == outputFileName:
                        file = os.path.join(dirpath,outputFileName)
                        os.remove(file)
        
        
        
            ghFolderPath = os.path.dirname(ghFilePath)
            outputFolder = os.path.join(ghFolderPath,'assembleData')
            wrapperFile = os.path.join( outputFolder,'openSeesModel.txt' )
        
            userObjectFolder = gh.Folders.DefaultUserObjectFolder
            pythonInterpreter = os.path.join(userObjectFolder, r'Alpaca4d\Analyses\WPy64\scripts\winpython.bat')
            fileName = os.path.join(userObjectFolder, r'Alpaca4d\Analyses\LinearAnalyses\openSees_StaticSolver.py')
            
            wrapperFile = '"' + wrapperFile + '"'
            fileName = '"' + fileName + '"'
            
            p = System.Diagnostics.Process()
            p.StartInfo.RedirectStandardOutput = True
            p.StartInfo.RedirectStandardError = True
        
            p.StartInfo.UseShellExecute = False
            p.StartInfo.CreateNoWindow = True
            
            p.StartInfo.FileName = pythonInterpreter
            p.StartInfo.Arguments = fileName + " " + wrapperFile
            p.Start()
            p.WaitForExit()
            
            
            msg = p.StandardError.ReadToEnd()
            ghenv.Component.AddRuntimeMessage(gh.Kernel.GH_RuntimeMessageLevel.Error, msg)
        
        
            ## READ THE OUTPUT FROM THE OPEENSEES_SOLVER
            ## THE ORDER MUST BE THE SAME OF THE OUTPUT LIST IN OpenSeesStaticSolver.py
        
            outputFile = os.path.join(outputFolder, outputFileName)
        
            with open(outputFile, 'r') as f:
                lines = f.readlines()
                nodeDisplacementWrapper = eval( lines[0].strip() )
                reactionWrapper = eval( lines[1].strip() )
                elementOutputWrapper = eval( lines[2].strip() )
                elementLoadWrapper = eval( lines[3].strip() )
                eleForceWrapper = eval( lines[4].strip() )
        
        
            AlpacaLinearStaticOutput = ([nodeDisplacementWrapper,
                                    reactionWrapper,
                                    elementOutputWrapper,
                                    elementLoadWrapper,
                                    eleForceWrapper])
        
            return AlpacaLinearStaticOutput
        
        
        checkData = True
        
        if not AlpacaModel:
            checkData = False
            msg = "input 'AlpacaModel' failed to collect data"
            ghenv.Component.AddRuntimeMessage(gh.Kernel.GH_RuntimeMessageLevel.Warning, msg)
        
        
        if checkData != False:
            AlpacaStaticOutput = InitializeStaticAnalysis(AlpacaModel)
            #maxDisplacement = None
            return AlpacaStaticOutput
# ---------- end analyze ----------
range_3 = Range(Domain=construct_domain_4, Steps=number_slider_8)  # disabled
panel_17 = Panel("0.005")  # disabled
sine = Sine(Value=range_2)  # disabled
panel_18 = Panel("20")  # disabled
arccosine = ArcCosine(Value=range_3)  # disabled
toggle_2 = BooleanToggle(False)  # disabled
sine_2 = Sine(Value=range_3)  # disabled
panel_19 = Panel("0.08")  # disabled
graph = QuickGraph(sine, SortOrder=0)  # disabled
toggle_3 = BooleanToggle(False)  # disabled

# ----
# WIP
data_13 = Data()
toggle_4 = BooleanToggle(True)
python_14 = GhPythonScript(
    AlpacaModel=data_13,
    LineModel=Toggle(True),
    ExtrudedModel=Toggle(True),
    Support=Toggle(True),
    Mass=Toggle(True),
    LocalAxis=Toggle(True),
    Load=Toggle(True),
    NodeTag=toggle_4,
    ElementTag=toggle_4)  # -> ModelCurve, ModelShell, ModelSolid; inputs AlpacaModel: list, LineModel: Boolean, ExtrudedModel: Boolean, Support: Boolean, Mass: Boolean, LocalAxis: Boolean, Load: Boolean, NodeTag: Boolean, ElementTag: Boolean
# ---------- python_14: Python ----------
"""Generate Model view 
    Inputs:
        AlpacaModel: Output of Assemble Model.
        LineModel: True: Visualise the stick Model. Default is False
        ExtrudedModel: True: Visualise the Extruded Model. Default is True
        Support: True: Visualise the Support. Default is True
        Mass: True: Visualise the Concentrated Mass. Default is False
        LocalAxes: True: Visualise the LocalAxis. Default is False
        Load: True: Visualise the Load. Default is False
        NodeTag: True: Visualise the NodeTag. Default is False
        ElementTag: True: Visualise the ElementTag. Default is False
    Output:
        out:
       """

from ghpythonlib.componentbase import executingcomponent as component
import Grasshopper, GhPython
import System
import Rhino
import rhinoscriptsyntax as rs

class VisualiseModellll(component):
    
    def RunScript(self, AlpacaModel, LineModel, ExtrudedModel, Support, Mass, LocalAxis, Load, NodeTag, ElementTag):
        
        import Rhino.Geometry as rg
        import math as mt
        import ghpythonlib.treehelpers as th
        import Grasshopper as gh
        import rhinoscriptsyntax as rs
        import sys
        import Rhino as rc
        import System.Drawing.Color
        import scriptcontext as sc
        
        
        def VisualiseModel(AlpacaModel, LineModel, ExtrudedModel, Support, Mass, LocalAxis, Load, NodeTag, ElementTag):
        
            LineModel = False if LineModel is None else LineModel
            ExtrudedModel = True if ExtrudedModel is None else ExtrudedModel
            Support = True if Support is None else Support
            Mass = False if Mass is None else Mass
            LocalAxis = False if LocalAxis is None else LocalAxis
            Load = False if Load is None else Load
            NodeTag = False if NodeTag is None else NodeTag
            ElementTag = False if ElementTag is None else ElementTag
            
            
            def linspace(a, b, n=100):
                if n < 2:
                    return b
                diff = (float(b) - a)/(n - 1)
                return [diff * i + a  for i in range(n)]
            
            def AddRectangleFromCenter(plane, width, height):
                a = plane.PointAt(-width * 0.5, -height * 0.5 )
                b = plane.PointAt(-width * 0.5,  height * 0.5 )
                c = plane.PointAt( width * 0.5,  height * 0.5 )
                d = plane.PointAt( width * 0.5,  -height * 0.5 )
                #rectangle = rg.PolylineCurve( [a, b, c, d, a] )
                rectangle  = [a, b, c, d] 
                return rectangle
            
            def AddCircleFromCenter( plane, radius):
                t = linspace( 0 , 1.85*mt.pi, 15 )
                a = []
                for ti in t:
                    x = radius*mt.cos(ti)
                    y = radius*mt.sin(ti)
                    a.append( plane.PointAt( x, y ) )
                #circle = rg.PolylineCurve( a )
                circle  = a 
                return circle
            
            def AddIFromCenter(plane, Bsup, tsup, Binf, tinf, H, ta, yg):
                #-------------------1---------2 #
                p1 = plane.PointAt( -(yg - tinf), ta/2 )
                p2 = plane.PointAt( -(yg - tinf), Binf/2 )
                p3 = plane.PointAt( -yg, Binf/2 )
                p4 = plane.PointAt( -yg, -Binf/2 )
                p5 = plane.PointAt( -(yg - tinf), -Binf/2 ) 
                p6 = plane.PointAt( -(yg - tinf), -ta/2 )
                p7 = plane.PointAt( (H - yg - tsup), -ta/2)
                p8 = plane.PointAt( (H - yg - tsup), -Bsup/2 )
                p9 = plane.PointAt( (H - yg ), -Bsup/2 )
                p10 = plane.PointAt( (H - yg ), Bsup/2 )
                p11 = plane.PointAt( (H - yg - tsup), Bsup/2 )
                p12 = plane.PointAt( (H - yg - tsup), ta/2 )
            
                wirframe  = [ p1, p2, p3, p4, p5, p6, p7, p8, p9, p10, p11, p12 ] 
                return wirframe
            
            def ShellQuad( ele, node):
                eleTag = ele[1]
                eleNodeTag = ele[2]
                color = ele[5]
                thick = ele[4]
                index1 = eleNodeTag[0]
                index2 = eleNodeTag[1]
                index3 = eleNodeTag[2]
                index4 = eleNodeTag[3]
                
                ## CREO IL MODELLO  ##
                point1 = node.get( index1 -1 , "never")
                point2 = node.get( index2 -1 , "never")
                point3 = node.get( index3 -1 , "never")
                point4 =  node.get( index4 -1 , "never")
                
                shellModel = rg.Mesh()
                shellModel.Vertices.Add( point1 ) #0
                shellModel.Vertices.Add( point2 ) #1
                shellModel.Vertices.Add( point3 ) #2
                shellModel.Vertices.Add( point4 ) #3
                
                
                shellModel.Faces.AddFace(0, 1, 2, 3)
                colour = rs.CreateColor( color[0], color[1], color[2] )
                shellModel.VertexColors.CreateMonotoneMesh( colour )
            
                vt = shellModel.Vertices
                shellModel.FaceNormals.ComputeFaceNormals()
                fid,MPt = shellModel.ClosestPoint(vt[0],0.01)
                normalFace = shellModel.FaceNormals[fid]
                vectormoltiplicate = rg.Vector3d.Multiply( -normalFace, thick/2 )
                trasl = rg.Transform.Translation( vectormoltiplicate )
                moveShell = rg.Mesh.DuplicateMesh(shellModel)
                moveShell.Transform( trasl )
                extrudeShell = rg.Mesh.Offset( moveShell, thick, True, normalFace)
                
                return  [ shellModel, extrudeShell ] 
            
            def ShellTriangle( ele, node ):
                
                eleTag = ele[1]
                eleNodeTag = ele[2]
                thick = ele[4]
                color = ele[5]
                index1 = eleNodeTag[0]
                index2 = eleNodeTag[1]
                index3 = eleNodeTag[2]
                
                
                ## CREO IL MODELLO DEFORMATO  ##
                point1 =  node.get( index1 -1 , "never")
                point2 =  node.get( index2 -1 , "never")
                point3 =  node.get( index3 -1 , "never")
                
                shellModel = rg.Mesh()
                shellModel.Vertices.Add( point1 ) #0
                shellModel.Vertices.Add( point2 ) #1
                shellModel.Vertices.Add( point3 ) #2
                
                shellModel.Faces.AddFace(0, 1, 2)
                colour = rs.CreateColor( color[0], color[1], color[2] )
                shellModel.VertexColors.CreateMonotoneMesh( colour )
                
                vt = shellModel.Vertices
                shellModel.FaceNormals.ComputeFaceNormals()
                fid,MPt = shellModel.ClosestPoint(vt[0],0.01)
                normalFace = shellModel.FaceNormals[fid]
                vectormoltiplicate = rg.Vector3d.Multiply( -normalFace, thick/2 ) 
                trasl = rg.Transform.Translation( vectormoltiplicate )
                moveShell = rg.Mesh.DuplicateMesh(shellModel)
                moveShell.Transform( trasl )
                extrudeShell = rg.Mesh.Offset( moveShell, thick, True, normalFace)
                
                return  [ shellModel, extrudeShell ]
            
            def Solid( ele, node ):
                
                eleTag = ele[1]
                eleNodeTag = ele[2]
                color = ele[5]
                #print( eleNodeTag )
                index1 = eleNodeTag[0]
                index2 = eleNodeTag[1]
                index3 = eleNodeTag[2]
                index4 = eleNodeTag[3]
                index5 = eleNodeTag[4]
                index6 = eleNodeTag[5]
                index7 = eleNodeTag[6]
                index8 = eleNodeTag[7]
                
                ## CREO IL MODELLO DEFORMATO  ##
                point1 =  node.get( index1 -1 , "never")
                point2 =  node.get( index2 -1 , "never")
                point3 =  node.get( index3 -1 , "never")
                point4 =  node.get( index4 -1 , "never")
                point5 =  node.get( index5 -1 , "never")
                point6 =  node.get( index6 -1 , "never")
                point7 =  node.get( index7 -1 , "never")
                point8 =  node.get( index8 -1 , "never")
                #print( type(pointDef1) ) 
                shellDefModel = rg.Mesh()
                shellDefModel.Vertices.Add( point1 ) #0
                shellDefModel.Vertices.Add( point2 ) #1
                shellDefModel.Vertices.Add( point3 ) #2
                shellDefModel.Vertices.Add( point4 ) #3
                shellDefModel.Vertices.Add( point5 ) #4
                shellDefModel.Vertices.Add( point6 ) #5
                shellDefModel.Vertices.Add( point7 ) #6
                shellDefModel.Vertices.Add( point8 ) #7
            
                shellDefModel.Faces.AddFace(0, 1, 2, 3)
                shellDefModel.Faces.AddFace(4, 5, 6, 7)
                shellDefModel.Faces.AddFace(0, 1, 5, 4)
                shellDefModel.Faces.AddFace(1, 2, 6, 5)
                shellDefModel.Faces.AddFace(2, 3, 7, 6)
                shellDefModel.Faces.AddFace(3, 0, 4, 7)
                
                colour = rs.CreateColor( color[0], color[1], color[2] )
                shellDefModel.VertexColors.CreateMonotoneMesh( colour )
                return  shellDefModel
            
            def TetraSolid( ele, node ):
                
                eleTag = ele[1]
                eleNodeTag = ele[2]
                color = ele[5]
                #print( eleNodeTag )
                index1 = eleNodeTag[0]
                index2 = eleNodeTag[1]
                index3 = eleNodeTag[2]
                index4 = eleNodeTag[3]
                
                ## CREO IL MODELLO DEFORMATO  ##
                point1 =  node.get( index1 -1 , "never")
                point2 =  node.get( index2 -1 , "never")
                point3 =  node.get( index3 -1 , "never")
                point4 =  node.get( index4 -1 , "never")
                
                #print( type(pointDef1) )
                
                shellDefModel = rg.Mesh()
                shellDefModel.Vertices.Add( point1 ) #0
                shellDefModel.Vertices.Add( point2 ) #1
                shellDefModel.Vertices.Add( point3 ) #2
                shellDefModel.Vertices.Add( point4 ) #3
                
                
                shellDefModel.Faces.AddFace( 0, 1, 2 )
                shellDefModel.Faces.AddFace( 0, 1, 3 )
                shellDefModel.Faces.AddFace( 1, 2, 3 )
                shellDefModel.Faces.AddFace( 0, 2, 3 )
                colour = rs.CreateColor( color[0], color[1], color[2], 0 )
                shellDefModel.VertexColors.CreateMonotoneMesh( colour )
                
                return  shellDefModel
            
            def Beam( ele, node):
                TagEle = ele[1]
                indexStart = ele[2][0]
                indexEnd = ele[2][1]
                color = ele[16]
                dimSection = ele[14]
                pointStart = node.get( indexStart  , "never")
                pointEnd = node.get( indexEnd  , "never")
                line = rg.LineCurve( pointStart, pointEnd )
                axis1 =  rg.Vector3d( ele[13][0][0], ele[13][0][1], ele[13][0][2]  )
                axis2 =  rg.Vector3d( ele[13][1][0], ele[13][1][1], ele[13][1][2]  )
                axis3 =  rg.Vector3d( ele[13][2][0], ele[13][2][1], ele[13][2][2]  )
                versor = [ axis1, axis2, axis3 ] 
                
                planeStart = rg.Plane(pointStart, axis1, axis2)
                planeEnd = rg.Plane(pointEnd, axis1, axis2)
                plane = [ planeStart, planeEnd ]
                
                sectionForm = []
                sectionPolyline = []
                for sectionPlane in plane:
                    
                    if dimSection[0] == 'rectangular' :
                        width, height = dimSection[1], dimSection[2]
                        section = AddRectangleFromCenter( sectionPlane, width, height )
                        sectionForm.append( section )
                    elif dimSection[0] == 'circular' :
                        radius1  = dimSection[1]/2
                        radius2  = dimSection[1]/2 - dimSection[2]
                        section1 = AddCircleFromCenter( sectionPlane, radius1 )
                        section2 = AddCircleFromCenter( sectionPlane, radius2 )
                        sectionForm.append( [ section1, section2 ] )
                    elif dimSection[0] == 'doubleT' :
                        Bsup = dimSection[1]
                        tsup = dimSection[2]
                        Binf = dimSection[3]
                        tinf = dimSection[4]
                        H =  dimSection[5]
                        ta =  dimSection[6]
                        yg =  dimSection[7]
                        section = AddIFromCenter( sectionPlane, Bsup, tsup, Binf, tinf, H, ta, yg )
                        sectionForm.append( section )
                    elif dimSection[0] == 'rectangularHollow' :
                        width, height, thickness = dimSection[1], dimSection[2], dimSection[3]
                        section1 = AddRectangleFromCenter( sectionPlane, width, height )
                        section2 = AddRectangleFromCenter( sectionPlane, width - (2*thickness), height - (2*thickness) )
                        sectionForm.append( [ section1, section2 ] )
                    elif dimSection[0] == 'Generic' :
                        radius  = dimSection[1]
                        section = AddCircleFromCenter( sectionPlane, radius )
                        sectionForm.append( section )
                    #print(sectionForm)
            
                colour = rs.CreateColor( color[0], color[1], color[2] )
            
                if dimSection[0] == 'circular' :
                    sectionForm1 = [row[0] for row in sectionForm ]
                    sectionForm2 = [row[1] for row in sectionForm ]
                    meshExtr = meshLoft3( sectionForm1,  color )
                    meshExtr.Append( meshLoft3( sectionForm2,  color ) )
                    sectionStartEnd = [ [sectionForm1[0], sectionForm2[0]], [sectionForm1[-1], sectionForm2[-1]]  ]
                    for iSection in sectionStartEnd :
                        iMesh = rg.Mesh()
                        for iPoint, jPoint in zip(iSection[0],iSection[1])  :
                            iMesh.Vertices.Add( iPoint )
                            iMesh.Vertices.Add( jPoint )
                        for i in range(0,len(iSection[0]) - 1): # sistemare
                            index1 = i*2 # 0
                            index2 = index1 + 1 #1
                            index3 = index1 + 3 #2
                            index4 = index1 + 2 #3
                            iMesh.Faces.AddFace(index1, index2, index3, index4)
                        iMesh.Faces.AddFace(index4, index3, 1, 0)
                        iMesh.VertexColors.CreateMonotoneMesh( colour )
                        meshExtr.Append( iMesh )
                        #meshExtr.IsClosed()
                elif  dimSection[0] == 'rectangular' : 
                    meshExtr = meshLoft3( sectionForm,  color )
                    sectionStartEnd = [ sectionForm[0], sectionForm[-1] ]
                    for iSection in sectionStartEnd :
                        iMesh = rg.Mesh()
                        for iPoint in iSection :
                             iMesh.Vertices.Add( iPoint )
                        iMesh.Faces.AddFace(0, 1, 2, 3)
                        iMesh.VertexColors.CreateMonotoneMesh( colour )
                        meshExtr.Append( iMesh )
                elif  dimSection[0] == 'doubleT' : 
                    meshExtr = meshLoft3( sectionForm,  color )
                    sectionStartEnd = [ sectionForm[0], sectionForm[-1] ]
                    for iSection in sectionStartEnd :
                        iMesh = rg.Mesh()
                        for iPoint in iSection :
                             iMesh.Vertices.Add( iPoint )
                        iMesh.Faces.AddFace( 0, 1, 2 )
                        iMesh.Faces.AddFace(2, 3, 5, 0 )
                        iMesh.Faces.AddFace( 3, 4, 5 )
                        iMesh.Faces.AddFace( 5, 6, 11, 0 )
                        iMesh.Faces.AddFace( 6, 7, 8 )
                        iMesh.Faces.AddFace( 8, 9, 11, 6 )
                        iMesh.Faces.AddFace( 9, 10, 11 )
                        #iMesh.Faces.AddFace(3, 2, 1, 4)
                        #iMesh.Faces.AddFace( 5, 6, 11, 0 )
                        #iMesh.Faces.AddFace(7, 8, 9, 10)
                        iMesh.VertexColors.CreateMonotoneMesh( colour )
                        meshExtr.Append( iMesh ) 
                elif  dimSection[0] == 'rectangularHollow' : 
                    sectionForm1 = [row[0] for row in sectionForm ]
                    sectionForm2 = [row[1] for row in sectionForm ]
                    meshExtr = meshLoft3( sectionForm1,  color )
                    meshExtr.Append( meshLoft3( sectionForm2,  color ) )
                    sectionStartEnd = [ [sectionForm1[0], sectionForm2[0]], [sectionForm1[-1], sectionForm2[-1]]  ]
                    for iSection in sectionStartEnd :
                        iMesh = rg.Mesh()
                        for iPoint, jPoint in zip(iSection[0],iSection[1])  :
                            iMesh.Vertices.Add( iPoint )
                            iMesh.Vertices.Add( jPoint )
                        iMesh.Faces.AddFace(0, 1, 3, 2)
                        iMesh.Faces.AddFace(2, 3, 5, 4)
                        iMesh.Faces.AddFace(4, 5, 7, 6)
                        iMesh.Faces.AddFace(6, 7, 1, 0)
                        iMesh.VertexColors.CreateMonotoneMesh( colour )
                        meshExtr.Append( iMesh )
                        #meshExtr.IsClosed()
            
                elif dimSection[0] == 'Generic' :
                    meshExtr = meshLoft3( sectionForm,  color )
            
                return [ line, meshExtr, colour ]
            
            def meshLoft3( point, color ):
                #print( point )
                meshEle = rg.Mesh()
                pointSection1 = point
                for i in range(0,len(pointSection1)):
                    for j in range(0, len(pointSection1[0])):
                        vertix = pointSection1[i][j]
                        #print( type(vertix) )
                        meshEle.Vertices.Add( vertix ) 
                        #meshEle.VertexColors.Add( color[0],color[1],color[2] );
                k = len(pointSection1[0])
                for i in range(0,len(pointSection1)-1):
                    for j in range(0, len(pointSection1[0])):
                        if j < k-1:
                            index1 = i*k + j
                            index2 = (i+1)*k + j
                            index3 = index2 + 1
                            index4 = index1 + 1
                        elif j == k-1:
                            index1 = i*k + j
                            index2 = (i+1)*k + j
                            index3 = (i+1)*k
                            index4 = i*k
                        meshEle.Faces.AddFace(index1, index2, index3, index4)
                        #rs.ObjectColor(scyl,(255,0,0))
                colour = rs.CreateColor( color[0], color[1], color[2] )
                meshEle.VertexColors.CreateMonotoneMesh( colour )
                meshElement = meshEle
                
                return meshElement
            
            def AddBoxFromCenter(plane, width, height):
                a = plane.PointAt(-width * 0.5, -width * 0.5 )
                b = plane.PointAt(-width * 0.5,  width * 0.5 )
                c = plane.PointAt( width * 0.5,  width * 0.5 )
                d = plane.PointAt( width * 0.5,  -width * 0.5 )
                rectangle1 = rg.Brep.CreateFromCornerPoints( a, b, c, d, 0.01)
                box = rg.Brep.CreateOffsetBrep( rectangle1, height, True, True, 0.01 )
                return box
            
            def AddForm1Center(plane, width, height):
                surf = rg.Brep()
                a = plane.PointAt(-width * 0.25, -width * 0.25 )
                b = plane.PointAt(-width * 0.25,  width * 0.25 )
                c = plane.PointAt( width * 0.25,  width * 0.25 )
                d = plane.PointAt( width * 0.25,  -width * 0.25 )
                rectangle1 = rg.Brep.CreateFromCornerPoints( a, b, c, d, 0.01)
                rectangleCurve1 = rg.PolylineCurve( [ a, b, c, d, a] )
                e = plane.PointAt(-width * 0.5, -width * 0.5 )
                f = plane.PointAt(-width * 0.5,  width * 0.5 )
                g = plane.PointAt( width * 0.5,  width * 0.5 )
                h = plane.PointAt( width * 0.5,  -width * 0.5 )
                rectangle2 = rg.Brep.CreateFromCornerPoints( e, f, g, h, 0.01)
                rectangleCurve2 = rg.PolylineCurve( [ e, f, g, h, e] )
                vectorMove = rg.Vector3d( 0, 0, -height )
                trasl = rg.Transform.Translation( vectorMove )
                rectangle2.Transform( trasl )
                rectangleCurve2.Transform( trasl )
                surf.Append( rectangle1 )
                surf.Append( rectangle2 )
                pyramidTrunk = rg.Brep.CreateFromLoft( [ rectangleCurve1, rectangleCurve2 ], rg.Point3d.Unset, rg.Point3d.Unset, rg.LoftType.Straight, False )
                for pyramid in pyramidTrunk:
                    surf.Append( pyramid )
                return  surf 
            
            def AddForm2Center(plane, width, height):
                surf = rg.Brep()
                a = plane.PointAt(-width * 0.5, -width * 0.25 )
                b = plane.PointAt(-width * 0.5,  width * 0.25 )
                c = plane.PointAt( width * 0.5,  width * 0.25 )
                d = plane.PointAt( width * 0.5,  -width * 0.25 )
                rectangle1 = rg.Brep.CreateFromCornerPoints( a, b, c, d, 0.01)
                rectangleCurve1 = rg.PolylineCurve( [ a, b, c, d, a] )
                e = plane.PointAt(-width * 0.5, -width * 0.5 )
                f = plane.PointAt(-width * 0.5,  width * 0.5 )
                g = plane.PointAt( width * 0.5,  width * 0.5 )
                h = plane.PointAt( width * 0.5,  -width * 0.5 )
                rectangle2 = rg.Brep.CreateFromCornerPoints( a, b, c, d, 0.01)
                rectangleCurve2 = rg.PolylineCurve( [ e, f, g, h, e] )
                vectorMove = rg.Vector3d( 0, 0, -height )
                trasl = rg.Transform.Translation( vectorMove )
                rectangle2.Transform( trasl )
                rectangleCurve2.Transform( trasl )
                surf.Append( rectangle1 )
                surf.Append( rectangle2 )
                pyramidTrunk = rg.Brep.CreateFromLoft( [ rectangleCurve1, rectangleCurve2 ], rg.Point3d.Unset, rg.Point3d.Unset, rg.LoftType.Straight, False )
                for pyramid in pyramidTrunk:
                    surf.Append( pyramid )
                return  surf 
            
            def AddForm3Center(plane, width, height):
                surf = rg.Brep()
                a = plane.PointAt(-width * 0.25, -width * 0.5 )
                b = plane.PointAt(-width * 0.25,  width * 0.5 )
                c = plane.PointAt( width * 0.25,  width * 0.5 )
                d = plane.PointAt( width * 0.25,  -width * 0.5 )
                rectangle1 = rg.Brep.CreateFromCornerPoints( a, b, c, d, 0.01)
                rectangleCurve1 = rg.PolylineCurve( [ a, b, c, d, a] )
                e = plane.PointAt(-width * 0.5, -width * 0.5 )
                f = plane.PointAt(-width * 0.5,  width * 0.5 )
                g = plane.PointAt( width * 0.5,  width * 0.5 )
                h = plane.PointAt( width * 0.5,  -width * 0.5 )
                rectangle2 = rg.Brep.CreateFromCornerPoints( a, b, c, d, 0.01)
                rectangleCurve2 = rg.PolylineCurve( [ e, f, g, h, e] )
                vectorMove = rg.Vector3d( 0, 0, -height )
                trasl = rg.Transform.Translation( vectorMove )
                rectangle2.Transform( trasl )
                rectangleCurve2.Transform( trasl )
                surf.Append( rectangle1 )
                surf.Append( rectangle2 )
                pyramidTrunk = rg.Brep.CreateFromLoft( [ rectangleCurve1, rectangleCurve2 ], rg.Point3d.Unset, rg.Point3d.Unset, rg.LoftType.Straight, False )
                for pyramid in pyramidTrunk:
                    surf.Append( pyramid )
                return  surf 
            
            
            #---------------------------------------------------------------------------------------#
            
            
            nodeWrapper = AlpacaModel[0]
            GeomTransf = AlpacaModel[1]
            openSeesBeam = AlpacaModel[2]
            openSeesSupport = AlpacaModel[3]
            openSeesNodeLoad = AlpacaModel[4]
            openSeesNodalMass = AlpacaModel[5]
            openSeesBeamLoad = AlpacaModel[6]
            openSeesShell = AlpacaModel[8]
            openSeesSolid = AlpacaModel[10]
            
            
            
            #######
            ####### NodeTag
            #######
            
            pointWrapper = []
            for item in nodeWrapper:
                point = rg.Point3d(item[1],item[2],item[3])
                pointWrapper.append( [item[0], point ] )
            
            ## Dict. for point ##
            pointWrapperDict = dict( pointWrapper )
            
            posTag = [row[1] for row in pointWrapper ]
            nodeTag = [row[0] for row in pointWrapper ]
            
            """
            if NodeTag:
                self.posTag = posTag
                self.nodeTag = nodeTag
                cameraX = sc.doc.Views.ActiveView.ActiveViewport.CameraX
                cameraY = sc.doc.Views.ActiveView.ActiveViewport.CameraY
                for pos, index in zip(posTag, nodeTag):
                    cd.AddText( rc.Display.Text3d( str(index) , rc.Geometry.Plane(pos, cameraX, cameraY) , 0.3 )    ,  System.Drawing.Color.Black)
            """
            
            model = []
            extrudedModel = []
            line = []
            colorLine = []
            shellVisualise = []
            
            eleTag = []
            posEleTag = []
            for ele in openSeesBeam :
                eleTag.append(ele[1])
                beamModel = Beam( ele, pointWrapperDict )
                line.append( beamModel[0] )
                posEleTag.append( beamModel[0].PointAtNormalizedLength(0.5) )
                colorLine.append( beamModel[2] )
                model.append([ ele[1], beamModel[0] ])
                extrudedModel.append([ ele[1], beamModel[1] ])
            
            for ele in openSeesShell :
                nNode = len( ele[2] )
                eleTag.append( ele[1] )
                if nNode == 4 :
                    shellModel = ShellQuad( ele, pointWrapperDict )
                    calcPropSection = rg.AreaMassProperties.Compute( shellModel[0], False, True, False, False )
                    centroid = calcPropSection.Centroid
                    posEleTag.append( centroid )
                elif nNode == 3:
                    #print( nNode )
                    shellModel = ShellTriangle( ele, pointWrapperDict )
                    calcPropSection = rg.AreaMassProperties.Compute( shellModel[0], False, True, False, False )
                    centroid = calcPropSection.Centroid
                    posEleTag.append( centroid )
                
                shellVisualise.append(shellModel[0])
                model.append([ ele[1] ,shellModel[0] ])
                extrudedModel.append([ ele[1],shellModel[1] ])
            
            
            
            brickVisualise = []
            for ele in openSeesSolid :
                nNode = len( ele[2] )
                eleTag.append( ele[1] )
                eleType = ele[0] 
                if nNode == 8:
                    solidModel = Solid( ele, pointWrapperDict )
                    calcPropSection = rg.AreaMassProperties.Compute( solidModel, False, True, False, False )
                    centroid = calcPropSection.Centroid
                    posEleTag.append( centroid )
                elif  eleType == 'FourNodeTetrahedron' :
                    #print(ele)
                    solidModel = TetraSolid( ele, pointWrapperDict )
                    calcPropSection = rg.AreaMassProperties.Compute( solidModel, False, True, False, False )
                    centroid = calcPropSection.Centroid
                    posEleTag.append( centroid )
                brickVisualise.append(solidModel)
            
                model.append([ ele[1], solidModel ])
                extrudedModel.append([ ele[1], solidModel ])
            
            
            
            #######
            ####### ElementTag
            #######
            
            
            tagEle = th.list_to_tree( [ posEleTag, eleTag ]  )
            """
            if ElementTag:
                for pos, index in zip(posEleTag, eleTag):
                    cameraX = sc.doc.Views.ActiveView.ActiveViewport.CameraX
                    cameraY = sc.doc.Views.ActiveView.ActiveViewport.CameraY
                    cd.AddText( rc.Display.Text3d( str(index) , rc.Geometry.Plane(pos, cameraX, cameraY)  , 0.3 )    ,  System.Drawing.Color.Red)
            """
            
            # --------------------------------#
            modelDict = dict( model )
            modelExstrudedDict = dict( extrudedModel )
            ModelView = []
            ModelViewExtruded = []
            for i in range(0,len(modelDict)):
                ModelView.append( modelDict.get( i  , "never" ))
                ModelViewExtruded.append( modelExstrudedDict.get( i , "never" ))
            
            #--------------------------------#
            
            
            
            lineModel = th.list_to_tree( [ line, colorLine ]  )
            
            #######
            ####### LocalAxis
            #######
            
            
            midPoint = []
            v3Display = []
            v2Display = []
            v1Display = []
            versorLine = []
            
            for ele in openSeesBeam :
                tag = ele[1]
                indexStart = ele[2][0]
                indexEnd = ele[2][1]
                propSection = ele[13]
                ## creo la linea ##
                lineAxis = rg.LineCurve( pointWrapperDict.get( indexStart  , "never"), pointWrapperDict.get( indexEnd  , "never"))
                MidPoint =  lineAxis.PointAtNormalizedLength(0.5)
                ## creo i versori  ##
                axis1 =  rg.Vector3d( ele[13][0][0], ele[13][0][1], ele[13][0][2]  )
                axis2 =  rg.Vector3d( ele[13][1][0], ele[13][1][1], ele[13][1][2]  )
                axis3 =  rg.Vector3d( ele[13][2][0], ele[13][2][1], ele[13][2][2]  )
                versor = [ axis1, axis2, axis3 ] 
                versorLine.append( [ tag ,versor ]  )
                midPoint.append( MidPoint )
                v3Display.append( axis3 )
                v2Display.append( axis2  )
                v1Display.append( axis1  )
            
            
            VersorLine = dict( versorLine )
            
            
            if LocalAxis:
                self.midPoint = midPoint
                self.v1Display = v1Display
                self.v2Display = v2Display
                self.v3Display = v3Display
            
            
            
            #######
            ####### Force
            #######
            
            forceMax = []
            for force in openSeesNodeLoad :
                forceVector =  rg.Vector3d( force[1][0], force[1][1] , force[1][2]  )
                fmax = max( forceVector.X, forceVector.Y, forceVector.Z )
                fmin = min( forceVector.X, forceVector.Y, forceVector.Z )
                forceMax.append( max( [ fmax, mt.fabs(fmin) ] ) )
            
            
            for linearLoad in openSeesBeamLoad :
                forceVector =  rg.Vector3d( linearLoad[1][0], linearLoad[1][1] , linearLoad[1][2]  )
                fmax = max( forceVector.X, forceVector.Y, forceVector.Z )
                fmin = min( forceVector.X, forceVector.Y, forceVector.Z )
                forceMax.append( max( [ fmax, mt.fabs(fmin) ] ) )
            
            #print( forceMax )
            forceMin = min( forceMax )
            
            
            #scale = forceMax*0.1/coordMax 
            if forceMin > 0 :
                scale = 1/forceMin 
            else :
                scale = 0.2
            
            forceDisplay = []
            ancorPoint = []
            
            for force in openSeesNodeLoad :
                index = force[0]
                pos = pointWrapperDict.get( index  , "never") 
                forceVector =  rg.Vector3d( force[1][0], force[1][1] , force[1][2]  )
                ancorPoint.append( pos )
                forceDisplay.append(  forceVector*scale  )
                
            for linearLoad in openSeesBeamLoad :
                tag =  linearLoad[0]
                geomTransf = VersorLine.get( tag  , "never" )
                force1 = rg.Vector3d.Multiply( linearLoad[1][0], geomTransf[0] )
                force2 = rg.Vector3d.Multiply( linearLoad[1][1], geomTransf[1] )
                force3 = rg.Vector3d.Multiply( linearLoad[1][2], geomTransf[2] )
                forceVector =  rg.Vector3d.Multiply( force1 + force2 + force3, scale )
                lineBeam =  modelDict.get( tag  , "never" )
                Length = rg.Curve.GetLength( lineBeam )
                divideDistance = 0.5
                DivCurve = lineBeam.DivideByLength( divideDistance, True )
                if DivCurve == None:
                    DivCurve = [ 0, Length]
            
                for index, x in enumerate(DivCurve):
                    beamPoint = lineBeam.PointAt(DivCurve[index]) 
                    ancorPoint.append( beamPoint )
                    forceDisplay.append( forceVector )
                
            #######
            ####### Mass
            #######
            
            if len(openSeesNodalMass)>0:
                scaleMass  = max([row[1][0] for row in openSeesNodalMass ])
            else:
                scaleMass = 0
            if scaleMass > 0 :
                scaleMass = scaleMass
            else :
                scaleMass = 1
            
            massPos = []
            massValue = []
            for mass in openSeesNodalMass  :
                index  = mass[0]
                massPos.append(pointWrapperDict.get( index  , "never"))
                massValue.append(mass[1][0]/scaleMass)
            
            Mass = th.list_to_tree( [ massPos , massValue ] )
            
            #######
            #######Support
            #######
            
            supportBrep = []
            
            for support in openSeesSupport :
                index = support[0]
                pos = pointWrapperDict.get( index  , "never")
                center_point = rg.Point3d( pos )
                
                if support[1] == 1 and support[2] == 0 and support[3] == 1 and support[4] == 1 and support[5] == 1 and support[6] == 1 : # carrello lungo y
                    supp = rg.Brep()
                    plane = rg.Plane.WorldYZ
                    radius = 0.15
                    length = radius*3.50
                    vector = rg.Vector3d( -length/2, 0 , -2.5*radius ) 
                    vectorTrasl = rg.Point3d.Add( center_point, vector )
                    trasl = rg.Transform.Translation( vectorTrasl.X, vectorTrasl.Y, vectorTrasl.Z ) 
                    plane.Transform( trasl )
                    circle = rg.Circle(plane, radius/2)
                    brepCylinder = rg.Brep.CreateFromCylinder( rg.Cylinder(circle, length), True, True )
                    cylinder1 = rg.Brep.DuplicateBrep(brepCylinder)
                    traslc1 = rg.Transform.Translation( 0, -length/4, 0 )
                    cylinder1.Transform( traslc1 )
                    cylinder2 = rg.Brep.DuplicateBrep(brepCylinder)
                    supp.Append( cylinder1 )
                    traslc2 = rg.Transform.Translation( 0, length/4, 0 )
                    cylinder2.Transform( traslc2 )
                    supp.Append( cylinder2 )
                    plane2 = rg.Plane.WorldXY
                    vector2 = rg.Vector3d( 0, 0 , 0 ) 
                    vectorTrasl2 = rg.Point3d.Add( center_point, vector2 )
                    trasl2 = rg.Transform.Translation( vectorTrasl2.X, vectorTrasl2.Y, vectorTrasl2.Z ) 
                    plane2.Transform( trasl2 )
                    supp.Append( AddForm2Center(plane2, length, radius*2) )
                    supportBrep.append( supp )
                if support[1] == 0 and support[2] == 1 and support[3] == 1 and support[4] == 1 and support[5] == 1 and support[6] == 1 : # carrello lungo x
                    supp = rg.Brep()
                    plane = rg.Plane.WorldZX
                    radius = 0.15
                    length = radius*3.50
                    vector = rg.Vector3d( 0, -length/2 , -2.5*radius ) 
                    vectorTrasl = rg.Point3d.Add( center_point, vector )
                    trasl = rg.Transform.Translation( vectorTrasl.X, vectorTrasl.Y, vectorTrasl.Z ) 
                    plane.Transform( trasl )
                    circle = rg.Circle(plane, radius/2)
                    brepCylinder = rg.Brep.CreateFromCylinder( rg.Cylinder(circle, length), True, True ) 
                    cylinder1 = rg.Brep.DuplicateBrep(brepCylinder)
                    traslc1 = rg.Transform.Translation( -length/4, 0, 0 )
                    cylinder1.Transform( traslc1 )
                    cylinder2 = rg.Brep.DuplicateBrep(brepCylinder)
                    supp.Append( cylinder1 )
                    traslc2 = rg.Transform.Translation( length/4, 0, 0 )
                    cylinder2.Transform( traslc2 )
                    supp.Append( cylinder2 )
                    plane2 = rg.Plane.WorldXY
                    vector2 = rg.Vector3d( 0, 0 , 0 )
                    vectorTrasl2 = rg.Point3d.Add( center_point, vector2 )
                    trasl2 = rg.Transform.Translation( vectorTrasl2.X, vectorTrasl2.Y, vectorTrasl2.Z ) 
                    plane2.Transform( trasl2 )
                    supp.Append( AddForm3Center(plane2, length, radius*2) )
                    supportBrep.append( supp )
                if support[1] == 1 and support[2] == 1 and support[3] == 1 and support[4] == 0 and support[5] == 1  : # cerniera lungo x
                    supp = rg.Brep()
                    plane = rg.Plane.WorldYZ
                    radius = 0.15
                    length = radius*3.50
                    vector = rg.Vector3d( -length/2, 0 , -radius )
                    vectorTrasl = rg.Point3d.Add( center_point, vector )
                    trasl = rg.Transform.Translation( vectorTrasl.X, vectorTrasl.Y, vectorTrasl.Z ) 
                    plane.Transform( trasl )
                    circle = rg.Circle(plane, radius)
                    supp.Append( rg.Brep.CreateFromCylinder( rg.Cylinder(circle, length), True, True ) )
                    plane2 = rg.Plane.WorldXY
                    vector2 = rg.Vector3d( 0, 0 , -1.70*radius )
                    vectorTrasl2 = rg.Point3d.Add( center_point, vector2 )
                    trasl2 = rg.Transform.Translation( vectorTrasl2.X, vectorTrasl2.Y, vectorTrasl2.Z ) 
                    plane2.Transform( trasl2 )
                    supp.Append( AddForm2Center(plane2, length, radius*2) )
                    supportBrep.append( supp )
                if support[1] == 1 and support[2] == 1 and support[3] == 1 and support[4] == 1 and support[5] == 0  : # cerniera lungo y
                    supp = rg.Brep()
                    plane = rg.Plane.WorldZX
                    radius = 0.15
                    length = radius*3.50
                    vector = rg.Vector3d( 0, -length/2 , -radius ) 
                    vectorTrasl = rg.Point3d.Add( center_point, vector )
                    trasl = rg.Transform.Translation( vectorTrasl.X, vectorTrasl.Y, vectorTrasl.Z ) 
                    plane.Transform( trasl )
                    circle = rg.Circle(plane, radius)
                    supp.Append( rg.Brep.CreateFromCylinder( rg.Cylinder(circle, length), True, True ) )
                    plane2 = rg.Plane.WorldXY
                    vector2 = rg.Vector3d( 0, 0 , -1.70*radius )
                    vectorTrasl2 = rg.Point3d.Add( center_point, vector2 )
                    trasl2 = rg.Transform.Translation( vectorTrasl2.X, vectorTrasl2.Y, vectorTrasl2.Z ) 
                    plane2.Transform( trasl2 )
                    supp.Append( AddForm3Center(plane2, length, radius*2) )
                    supportBrep.append( supp )
                if support[1] == 1 and support[2] == 1 and support[3] == 1 and support[4] == 0 and support[5] == 0   : # cerniera sferica
                    radius = 0.15
                    length = radius*3.50
                    vector = rg.Vector3d( 0, 0 , -radius ) 
                    center =  rg.Point3d.Add( center_point, vector )
                    supp = rg.Brep()
                    # sfera
                    supp.Append( rg.Brep.CreateFromSphere(rg.Sphere( center, radius)))
                    plane = rg.Plane.WorldXY
                    vectorTrasl = rg.Point3d.Add( center_point, 1.70*vector )
                    trasl = rg.Transform.Translation( vectorTrasl.X, vectorTrasl.Y, vectorTrasl.Z  )
                    plane.Transform( trasl )
                    # tronco di piramide
                    supp.Append( AddForm1Center(plane, length, radius*2) )
                    supportBrep.append( supp )
                if support[1] == 1 and support[2] == 1 and support[3] == 1 and support[4] == 1 and support[5] == 1  and support[6] == 1 : # incastro
                    plane = rg.Plane.WorldXY
                    length = 0.5
                    h = length/3
                    vector = rg.Vector3d( 0, 0 , 0 )
                    vectorTrasl = rg.Point3d.Add( center_point, vector )
                    trasl = rg.Transform.Translation( vectorTrasl.X, vectorTrasl.Y, vectorTrasl.Z  )
                    plane2 = rg.Plane.Clone( plane )
                    plane2.Transform( trasl )
                    supp = AddBoxFromCenter(plane2, length, h)[0]
                    supportBrep.append( supp[0] )
            
            if LineModel == True:
                self.line = line
                self.colorLine = colorLine
            if Load == True:
                self.ancorPoint = ancorPoint
                self.forceDisplay = forceDisplay
            if NodeTag == True:
                self.posTag = posTag
                self.nodeTag = nodeTag
            if ElementTag == True:
                self.posEleTag = posEleTag
                self.eleTag = eleTag
            if Support == True:
                self.supportBrep = supportBrep
                self.material = rc.Display.DisplayMaterial(System.Drawing.Color.Cyan, 0.0)
            if ExtrudedModel == True:
                self.ModelViewExtruded = ModelViewExtruded
                self.materialMesh = rc.Display.DisplayMaterial(System.Drawing.Color.Blue)
            return line, shellVisualise, line
            
        checkData = True
        
        if not AlpacaModel:
            checkData = False
            msg = "input 'AlpacaModel' failed to collect data"
            ghenv.Component.AddRuntimeMessage(gh.Kernel.GH_RuntimeMessageLevel.Warning, msg)
        
        if checkData != False:
            ModelCurve, shellVisualise, ModelSolid = VisualiseModel(AlpacaModel, LineModel, ExtrudedModel, Support, Mass, LocalAxis, Load, NodeTag, ElementTag)
            return ModelCurve, shellVisualise, ModelSolid


    def DrawViewportWires(self,arg):
        
        for crv, color in zip(self.line, self.colorLine):
            arg.Display.DrawCurve(crv, color, 4)
        
        for ancor, force in zip(self.ancorPoint, self.forceDisplay):
            arg.Display.DrawMarker(ancor, force, System.Drawing.Color.Black)
        
        for pos, tag in zip(self.posTag, self.nodeTag):
            arg.Display.Draw2dText(str(tag), System.Drawing.Color.Blue, pos, True, 20)
        
        for pos, tag in zip(self.posEleTag, self.eleTag):
            arg.Display.Draw2dText(str(tag), System.Drawing.Color.Red, pos, True, 20)
        
        for midPoint, axis1, axis2, axis3 in zip( self.midPoint, self.v1Display, self.v2Display, self.v3Display):
            arg.Display.DrawLine( midPoint, midPoint + axis1, System.Drawing.Color.Red, 3 )
            arg.Display.DrawLine( midPoint, midPoint + axis2, System.Drawing.Color.Green, 3 )
            arg.Display.DrawLine( midPoint, midPoint + axis3, System.Drawing.Color.Blue, 3 )
            
        for brep in self.supportBrep:
            arg.Display.DrawBrepShaded(brep,self.material)
# ---------- end python_14 ----------
toggle_5 = BooleanToggle(False)  # disabled
path_3 = FilePath("C:\GitHub\Alpaca4d\PythonScript\Post-Processing\viewGroundAccAnalyses\viewGroundAccAnalyses.py")  # disabled
button = Button()  # disabled
reaction_forces_alpaca4d = ReactionForcesAlpaca4d()  # -> TagPoints, ReactionForce, ReactionMoment

# ---- group: Shell Stress Visualisation / spectral
merge_2 = Merge(
    Data1=ColourSwatch(SwatchColor=RGB(201, 0, 0)),
    Data2=ColourSwatch(SwatchColor=RGB(240, 69, 7)),
    Data3=ColourSwatch(SwatchColor=RGB(251, 255, 0)),
    Data4=ColourSwatch(SwatchColor=RGB(77, 255, 0)),
    Data5=ColourSwatch(SwatchColor=RGB(0, 153, 28)),
    Data6=ColourSwatch(SwatchColor=RGB(67, 136, 247)),
    Data7=ColourSwatch(SwatchColor=RGB(0, 30, 255)),
    Data8=ColourSwatch(SwatchColor=RGB(111, 0, 176)))

# ---- group: jet
colour_swatch = ColourSwatch(SwatchColor=RGB(0, 81, 255))  # disabled
colour_swatch_2 = ColourSwatch(SwatchColor=RGB(201, 0, 0))  # disabled
colour_swatch_3 = ColourSwatch(SwatchColor=RGB(240, 69, 7))  # disabled
colour_swatch_4 = ColourSwatch(SwatchColor=RGB(251, 255, 0))  # disabled
colour_swatch_5 = ColourSwatch(SwatchColor=RGB(77, 255, 0))  # disabled
colour_swatch_6 = ColourSwatch(SwatchColor=RGB(0, 255, 221))  # disabled
merge_3 = Merge(
    Data1=colour_swatch_2,
    Data2=colour_swatch_3,
    Data3=colour_swatch_4,
    Data4=colour_swatch_5,
    Data5=colour_swatch_6,
    Data6=colour_swatch)  # disabled

# ----
file_3 = ReadFile(File=path_3, PerLineParse=False)  # disabled

# ----
# Modal Animate
number_slider_9 = Slider(3, range=0..10)  # disabled
number_slider_10 = Slider(1, range=1..50)  # disabled
number_slider_11 = Slider(1, range=0..10)  # disabled
path_4 = FilePath("C:\GitHub\Alpaca4d\PythonScript\Post-Processing\animateModal\animateModal.py")  # disabled
toggle_6 = BooleanToggle(False)  # disabled
toggle_7 = BooleanToggle(False)  # disabled
button_2 = Button()  # disabled
file_4 = ReadFile(File=path_4, PerLineParse=False)  # disabled

# ----
# Disp Numerical Ouput
# OK!
# Force component
number_slider_12 = Slider(10, range=0..10)  # disabled
file_path_11 = FilePath("C:\GitHub\Alpaca4d\PythonScript\Post-Processing\beamDisp\beamDisp.py")  # disabled
file_path_12 = FilePath("C:\GitHub\Alpaca4d\PythonScript\Post-Processing\brickDisp\brickDisp.py")  # disabled
file_path_13 = FilePath("C:\GitHub\Alpaca4d\PythonScript\Post-Processing\shellDisp\shellDisp.py")  # disabled
file_path_14 = FilePath("C:\GitHub\Alpaca4d\PythonScript\Post-Processing\nodalDisp\nodalDisp.py")  # disabled
read_file_11 = ReadFile(File=file_path_11, PerLineParse=False)  # disabled
read_file_12 = ReadFile(File=file_path_13, PerLineParse=False)  # disabled
read_file_13 = ReadFile(File=file_path_14, PerLineParse=False)  # disabled
read_file_14 = ReadFile(File=file_path_12, PerLineParse=False)  # disabled

toggle_8 = BooleanToggle(False)  # disabled
list_2 = ValueList({"tx": 0, "ty": 1, "tz": 2, "txyz": 3}, selected="tx")  # disabled

# ---- group: hsv
colour_swatch_7 = ColourSwatch(SwatchColor=RGB(0, 30, 255))  # disabled
colour_swatch_8 = ColourSwatch(SwatchColor=RGB(240, 69, 7))  # disabled
colour_swatch_9 = ColourSwatch(SwatchColor=RGB(251, 255, 0))  # disabled
colour_swatch_10 = ColourSwatch(SwatchColor=RGB(77, 255, 0))  # disabled
colour_swatch_11 = ColourSwatch(SwatchColor=RGB(0, 255, 221))  # disabled
colour_swatch_12 = ColourSwatch(SwatchColor=RGB(67, 136, 247))  # disabled
colour_swatch_13 = ColourSwatch(SwatchColor=RGB(135, 0, 176))  # disabled
colour_swatch_14 = ColourSwatch(SwatchColor=RGB(247, 0, 103))  # disabled
merge_4 = Merge(
    Data1=colour_swatch_8,
    Data2=colour_swatch_9,
    Data3=colour_swatch_10,
    Data4=colour_swatch_11,
    Data5=colour_swatch_12,
    Data6=colour_swatch_7,
    Data7=colour_swatch_13,
    Data8=colour_swatch_14)  # disabled

# ---- group: jet
merge_5 = Merge(
    Data1=ColourSwatch(SwatchColor=RGB(201, 0, 0)),
    Data2=ColourSwatch(SwatchColor=RGB(240, 69, 7)),
    Data3=ColourSwatch(SwatchColor=RGB(251, 255, 0)),
    Data4=ColourSwatch(SwatchColor=RGB(77, 255, 0)),
    Data5=ColourSwatch(SwatchColor=RGB(0, 255, 221)),
    Data6=ColourSwatch(SwatchColor=RGB(0, 81, 255)))

# ---- group: hsv
merge_6 = Merge(
    Data1=ColourSwatch(SwatchColor=RGB(240, 69, 7)),
    Data2=ColourSwatch(SwatchColor=RGB(251, 255, 0)),
    Data3=ColourSwatch(SwatchColor=RGB(77, 255, 0)),
    Data4=ColourSwatch(SwatchColor=RGB(0, 255, 221)),
    Data5=ColourSwatch(SwatchColor=RGB(67, 136, 247)),
    Data6=ColourSwatch(SwatchColor=RGB(0, 30, 255)),
    Data7=ColourSwatch(SwatchColor=RGB(135, 0, 176)),
    Data8=ColourSwatch(SwatchColor=RGB(247, 0, 103)))

# ---- group: spectral
colour_swatch_15 = ColourSwatch(SwatchColor=RGB(67, 136, 247))  # disabled
colour_swatch_16 = ColourSwatch(SwatchColor=RGB(0, 30, 255))  # disabled
colour_swatch_17 = ColourSwatch(SwatchColor=RGB(201, 0, 0))  # disabled
colour_swatch_18 = ColourSwatch(SwatchColor=RGB(240, 69, 7))  # disabled
colour_swatch_19 = ColourSwatch(SwatchColor=RGB(251, 255, 0))  # disabled
colour_swatch_20 = ColourSwatch(SwatchColor=RGB(77, 255, 0))  # disabled
colour_swatch_21 = ColourSwatch(SwatchColor=RGB(0, 153, 28))  # disabled
colour_swatch_22 = ColourSwatch(SwatchColor=RGB(111, 0, 176))  # disabled
merge_7 = Merge(
    Data1=colour_swatch_17,
    Data2=colour_swatch_18,
    Data3=colour_swatch_19,
    Data4=colour_swatch_20,
    Data5=colour_swatch_21,
    Data6=colour_swatch_15,
    Data7=colour_swatch_16,
    Data8=colour_swatch_22)  # disabled

merge_8 = Merge(
    Data1=ColourSwatch(SwatchColor=RGB(201, 0, 0)),
    Data2=ColourSwatch(SwatchColor=RGB(240, 69, 7)),
    Data3=ColourSwatch(SwatchColor=RGB(251, 255, 0)),
    Data4=ColourSwatch(SwatchColor=RGB(77, 255, 0)),
    Data5=ColourSwatch(SwatchColor=RGB(0, 153, 28)),
    Data6=ColourSwatch(SwatchColor=RGB(67, 136, 247)),
    Data7=ColourSwatch(SwatchColor=RGB(0, 30, 255)),
    Data8=ColourSwatch(SwatchColor=RGB(111, 0, 176)))

# ----
file_path_15 = FilePath("C:\GitHub\Alpaca4d\PythonScript\function\AlpacaColorMesh.py")  # disabled
read_file_15 = ReadFile(File=file_path_15, PerLineParse=False)  # disabled
list_3 = ValueList({"8Color": 0, "20Color": 1}, selected="8Color")  # disabled
ghpython_script = GhPythonScript(Code=read_file_15)  # -> Out, Color, Tag, Domain, ColorValue; disabled

curve_2 = Curve()  # disabled
number_slider_13 = Slider(4, range=0..10)  # disabled
toggle_9 = BooleanToggle(False)  # disabled
python_15 = GhPythonScript(Visualise=toggle_9, Weight=graft(number_slider_13))  # inputs Visualise: Boolean, Crv: list, Color: list; disabled
# ---------- python_15: Python ----------
import Rhino as rc
from scriptcontext import sticky as st


if True:
    for k,v in st.items():
        if type(v) is rc.Display.CustomDisplay:
            v.Dispose()
            del st[k]


def customDisplay(toggle,component):
    
    """ Make a custom display that is unique to the component and lives in sticky """
    
    # Make unique name and custom display
    displayGuid = "DomeDisplay_" + str(component.InstanceGuid)
    if displayGuid not in st:
        st[displayGuid] = rc.Display.CustomDisplay(True)
        
    # Clear display each time component runs
    st[displayGuid].Clear()
    
    # Return the display or get rid of it
    if toggle:
        return st[displayGuid]
    else:
        st[displayGuid].Dispose()
        del st[displayGuid]
        return None

cd = customDisplay(True,ghenv.Component)


if Visualise and not ghenv.Component.Hidden:
    for segment,colorList in zip(Crv,Color):
        print( segment )
        for crv, color in zip( segment, colorList ):
            cd.AddLine(crv,color,Weight)
# ---------- end python_15 ----------

circle = Circle(Plane=PlaneXY(0, 0, 0), Radius=Slider(10, range=0..10))
mesh_3 = Mesh(circle)
refine_2 = Refine(Mesh=mesh_3, Level="0")
weaverbird_s_naked_boundary = WeaverbirdsNakedBoundary(MeshClosedPolylines=refine_2)
number_slider_14 = Slider(2, range=0..100)
subtraction = Subtraction(A=number_slider_14, B="1")
explode_3 = Explode(Curve=weaverbird_s_naked_boundary, Recursive=True)  # -> Segments, Vertices
series_4 = Series(Start="0", Step="4", Count=number_slider_14)
removeduplicatepts_3 = RemoveDuplicatePts(Points=flatten(explode_3.Vertices), Tolerance=0.01)
series_5 = Series(Start="4", Step="4", Count=subtraction)
unit_z_4 = UnitZ(Factor=series_4)
unit_z_5 = UnitZ(Factor=series_5)
move_3 = Move(Geometry=graft(removeduplicatepts_3), Motion=unit_z_4)  # -> simplify(Geometry), Transform
move_4 = Move(Geometry=graft(refine_2), Motion=unit_z_5)  # -> Geometry, Transform
shift_list = ShiftList(List=move_3.Geometry, Shift=1, Wrap=True)
deconstruct_mesh_2 = DeconstructMesh(Mesh=move_4.Geometry)  # -> Vertices, Faces, Colours, Normals
removeduplicatepts_4 = RemoveDuplicatePts(Points=flatten(deconstruct_mesh_2.Vertices), Tolerance=0.01)
pdecon_5 = Deconstruct(Point=removeduplicatepts_4)  # -> XComponent, YComponent, ZComponent
larger_than_2 = LargerThan(FirstNumber=pdecon_5.XComponent, SecondNumber="9")  # -> LargerThan, OrEqualTo
vincoli = Point(removeduplicatepts_3)
cull_5 = CullPattern(List=removeduplicatepts_4, CullPattern=larger_than_2.LargerThan)  # -> flatten(List)
vec_8 = VectorXYZ(XComponent="-100", YComponent=0, ZComponent=0)  # -> Vector, Length
pointload_6 = Point(cull_5)
support_5 = Point(vincoli)

cull_nth = CullNth(List=simplify(shift_list), CullFrequency=number_slider_14)
cull_nth_2 = CullNth(List=simplify(move_3.Geometry), CullFrequency=number_slider_14)
mesh_explode = MeshExplode(Mesh=move_4.Geometry, Interpolate=False)

line_4 = Line(StartPoint=cull_nth_2, EndPoint=cull_nth)  # -> flatten(Line)
colonne = RemoveDuplicateLines(Lines=line_4, Tolerance=0.01)
entwine_5 = Entwine(
    Branch00=mesh_explode,
    Branch01=colonne,
    Branch03=support_5,
    Branch04=pointload_6,
    Branch05=vec_8.Vector,
    FlattenInputs=True)

rectangle = Rectangle(Plane=PlaneXY(0, 0, 0), XSize="10", YSize="20", Radius=0)  # -> Rectangle, Length
mesh_surface = MeshSurface(Surface=rectangle.Rectangle, UCount=number_slider, VCount=number_slider, Overhang=True, Equalize=False)
weaverbird_s_offset_mesh = WeaverbirdsOffsetMesh(MeshCurves=mesh_surface, Distance=graft(series), OffsetType=0)
entwine_6 = Entwine(Branch00=mesh_surface, Branch01=weaverbird_s_offset_mesh, FlattenInputs=True)
subtraction_2 = Subtraction(A="10", B="1")
vec_9 = VectorXYZ(XComponent=0, YComponent=0, ZComponent="-100")  # -> Vector, Length

move_5 = Move(Geometry=mesh_surface, Motion=unit_z_2)  # -> flatten(Geometry), Transform

# ---- group: brith to loft mesh
ghpython_script_2 = GhPythonScript(MeshSeries=move_5.Geometry, color=ColourSwatch(SwatchColor=RGB(4, 0, 255)))  # -> out, simplify(flatten(Brick)); inputs MeshSeries: list of Mesh
# ---------- ghpython_script_2: Python ----------
import Rhino.Geometry as rg

def MeshToShell(Mesh):
    
    Mesh.Unweld(0, True)
    mesh = Mesh.ExplodeAtUnweldedEdges()
    newMesh = []
    elementType = []
    for explodedMesh in mesh:
        newMesh.append(explodedMesh)
    return newMesh 

def brick( MeshList, color ):
    meshExpl = []
    Vertix = []
    elementType = []
    solid = []
    
    for Mesh in MeshList:
        shellWrapper = MeshToShell(Mesh)
        meshExpl.append( shellWrapper )
    for index1 in range(0, len(MeshList)-1):
        for index2 in range(0, len(meshExpl[0])):
            if meshExpl[ index1 ][ index2 ].Vertices.Count == 4:
                
                elementType.append("stdBrick")
                vertix1 = meshExpl[ index1 ][ index2 ].Vertices[0]
                vertix2 = meshExpl[ index1 ][ index2 ].Vertices[1]
                vertix3 = meshExpl[ index1 ][ index2 ].Vertices[2]
                vertix4 = meshExpl[ index1 ][ index2 ].Vertices[3]
                vertix5 = meshExpl[index1 + 1 ][ index2].Vertices[0]
                vertix6 = meshExpl[index1 + 1 ][ index2].Vertices[1]
                vertix7 = meshExpl[index1 + 1 ][ index2].Vertices[2]
                vertix8 = meshExpl[index1 + 1 ][ index2].Vertices[3]
                
                vertix = [ vertix1, vertix2, vertix3, vertix4,
                vertix5, vertix6, vertix7, vertix8 ]
                
                ele = rg.Mesh()
                
                ele.Vertices.Add( vertix1 ) # 0 
                ele.Vertices.Add( vertix2 ) # 1
                ele.Vertices.Add( vertix3 ) # 2
                ele.Vertices.Add( vertix4 ) # 3
                ele.Vertices.Add( vertix5 ) # 4
                ele.Vertices.Add( vertix6 ) # 5
                ele.Vertices.Add( vertix7 ) # 6
                ele.Vertices.Add( vertix8 ) # 7
                
                ele.VertexColors.Add(color)
                ele.VertexColors.Add(color)
                ele.VertexColors.Add(color)
                ele.VertexColors.Add(color)
                ele.VertexColors.Add(color)
                ele.VertexColors.Add(color)
                ele.VertexColors.Add(color)
                ele.VertexColors.Add(color)
    
                
                ele.Faces.AddFace(0, 1, 2, 3) # 0
                ele.Faces.AddFace(4, 5, 6, 7) # 1
                ele.Faces.AddFace(0, 1, 5, 4) # 2
                ele.Faces.AddFace(3, 2, 6, 7) # 3
                ele.Faces.AddFace(1, 5, 6, 2) # 4
                ele.Faces.AddFace(0, 4, 7, 3) # 5
                #ele.IsClosed()
                
            else :
                elementType.append(["FourNodeTetrahedron"]*3)
                
                if meshExpl[ index1 ][ index2 ].Vertices[0] == meshExpl[index1 + 1 ][ index2].Vertices[0] :
                    vertix1 = meshExpl[ index1 ][ index2 ].Vertices[0]
                    vertix2 = meshExpl[ index1 ][ index2 ].Vertices[1]
                    vertix3 = meshExpl[ index1 ][ index2 ].Vertices[2]
                    vertix4 = meshExpl[index1 + 1 ][ index2].Vertices[1]
                    vertix5 = meshExpl[index1 + 1 ][ index2].Vertices[2]
                    
                    vertixEle1 = [ vertix1, vertix2, vertix3, vertix4 ]
                    vertixEle2 = [ vertix1, vertix2, vertix3, vertix2 ]
                    
                    ele1 = rg.Mesh() # Tetrahedron 1
                    ele2 = rg.Mesh() # Tetrahedron 2
                    
                    ele1.Vertices.Add( vertix1 ) # 0 
                    ele1.Vertices.Add( vertix2 ) # 1
                    ele1.Vertices.Add( vertix3 ) # 2 
                    ele1.Vertices.Add( vertix4 ) # 3 
                    
                    ele1.VertexColors.Add(color)
                    ele1.VertexColors.Add(color)
                    ele1.VertexColors.Add(color)
                    ele1.VertexColors.Add(color)
                    
                    ele2.Vertices.Add( vertix1 ) # 0 
                    ele2.Vertices.Add( vertix2 ) # 1 
                    ele2.Vertices.Add( vertix3 ) # 2 
                    ele2.Vertices.Add( vertix2 ) # 3
    
                    ele2.VertexColors.Add(color)
                    ele2.VertexColors.Add(color)
                    ele2.VertexColors.Add(color)
                    ele2.VertexColors.Add(color)
                    
                    ele1.Faces.AddFace(0, 1, 4 ) # 0
                    ele1.Faces.AddFace(0, 1, 3 ) # 1
                    ele1.Faces.AddFace(0, 4, 3 ) # 2
                    ele1.Faces.AddFace(1, 3, 4 ) # 3
                    
                    ele2.Faces.AddFace(0, 1, 3 ) # 0
                    ele2.Faces.AddFace(0, 1, 2 ) # 1
                    ele2.Faces.AddFace(1, 2, 3 ) # 2
                    ele2.Faces.AddFace(0, 2, 3 ) # 3
                    
                    ele = [ ele1, ele2 ]
                    
                else :
                
                    vertix1 = meshExpl[ index1 ][ index2 ].Vertices[0]
                    vertix2 = meshExpl[ index1 ][ index2 ].Vertices[1]
                    vertix3 = meshExpl[ index1 ][ index2 ].Vertices[2]
                    vertix4 = meshExpl[index1 + 1 ][ index2].Vertices[0]
                    vertix5 = meshExpl[index1 + 1 ][ index2].Vertices[1]
                    vertix6 = meshExpl[index1 + 1 ][ index2].Vertices[2]
                    
                    vertixEle1 = [ vertix1, vertix2, vertix3, vertix6 ]
                    vertixEle2 = [ vertix4, vertix5, vertix6, vertix1 ]
                    vertixEle3 = [ vertix5, vertix6, vertix2, vertix1 ]
                    
                    vertix = [ vertixEle1, vertixEle2, vertixEle3 ]
                    
                    ele1 = rg.Mesh() # Tetrahedron 1
                    ele2 = rg.Mesh() # Tetrahedron 2
                    ele3 = rg.Mesh() # Tetrahedron 3
                    
                    ele1.Vertices.Add( vertix1 ) # 0 
                    ele1.Vertices.Add( vertix2 ) # 1
                    ele1.Vertices.Add( vertix3 ) # 2 
                    ele1.Vertices.Add( vertix6 ) # 3 
                    
                    ele1.VertexColors.Add(color)
                    ele1.VertexColors.Add(color)
                    ele1.VertexColors.Add(color)
                    ele1.VertexColors.Add(color)
                    
                    ele2.Vertices.Add( vertix4 ) # 0 
                    ele2.Vertices.Add( vertix5 ) # 1 
                    ele2.Vertices.Add( vertix6 ) # 2 
                    ele2.Vertices.Add( vertix1 ) # 3
    
                    ele2.VertexColors.Add(color)
                    ele2.VertexColors.Add(color)
                    ele2.VertexColors.Add(color)
                    ele2.VertexColors.Add(color)
                    
                    ele3.Vertices.Add( vertix5 ) # 0 
                    ele3.Vertices.Add( vertix6 ) # 1 
                    ele3.Vertices.Add( vertix2 ) # 2 
                    ele3.Vertices.Add( vertix1 ) # 3
                    
                    ele3.VertexColors.Add(color)
                    ele3.VertexColors.Add(color)
                    ele3.VertexColors.Add(color)
                    ele3.VertexColors.Add(color)
                    
                    ele1.Faces.AddFace(0, 1, 2 ) # 0
                    ele1.Faces.AddFace(0, 3, 1 ) # 1
                    ele1.Faces.AddFace(0, 3, 2 ) # 2
                    ele1.Faces.AddFace(1, 3, 2 ) # 3
                    
                    ele2.Faces.AddFace(0, 1, 2 ) # 0
                    ele2.Faces.AddFace(0, 3, 1 ) # 1
                    ele2.Faces.AddFace(0, 3, 2 ) # 2
                    ele2.Faces.AddFace(1, 3, 2 ) # 3
                    
                    ele3.Faces.AddFace(0, 1, 2 ) # 0
                    ele3.Faces.AddFace(0, 3, 1 ) # 1
                    ele3.Faces.AddFace(0, 3, 2 ) # 2
                    ele3.Faces.AddFace(1, 3, 2 ) # 3
                    
                    ele = [ ele1, ele2, ele3 ]
            
            solid.append(ele)
            Vertix.append( vertix )
    return solid, elementType

Brick, type = brick( MeshSeries, color )
# ---------- end ghpython_script_2 ----------

# ----
move_6 = Move(Geometry=graft(ghpython_script_2.Brick), Motion=unit_z_3)  # -> flatten(Geometry), Transform

# ----
# Model 0
number_slider_15 = Slider(-20, range=-20..20)
vec_10 = VectorXYZ(XComponent=number_slider_15, YComponent=0, ZComponent=0)  # -> Vector, Length
pointload_7 = Point([Point(0, 0, 10), Point(5, 0, 10), Point(0, 5, 5), Point(0, 5, 10), Point(0, 0, 5)])
vec_11 = VectorXYZ(XComponent=Slider(0, range=-20..20), YComponent=0, ZComponent=0)  # -> Vector, Length
support_6 = Point([Point(0, 0, 0), Point(5, 0, 0), Point(10, 0, 0), Point(15, 0, 0), Point(15, 5, 0), Point(10, 5, 0), Point(5, 5, 0), Point(0, 5, 0)])
shell_2 = Mesh([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])
beam_3 = Curve([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])
truss = Curve([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])
cantiliver = Curve([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])
columns_2 = Curve([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])
vec_12 = VectorXYZ(XComponent=0, YComponent=Slider(11, range=-20..20), ZComponent=0)  # -> Vector, Length
refine_3 = Refine(Mesh=shell_2, Level="2")
mesh_4 = Mesh(refine_3)
clean_2 = CombineClean(Meshes=mesh_4)
explode_4 = MeshExplode(Mesh=clean_2, Interpolate=False)  # -> flatten(Faces)

list_length = ListLength(List=pointload_7)
range_4 = Range(Domain=construct_domain, Steps=list_length)
multiplication = Multiplication(A=vec_6.Vector, B=range_4)
custom_preview = CustomPreview(Geometry=support_6, Material=ColourSwatch(SwatchColor=RGB(0, 0, 0)))

entwine_7 = Entwine(
    Branch00=explode_4,
    Branch01=beam_3,
    Branch02=truss,
    Branch03=support_6,
    Branch04=pointload_7,
    Branch05=vec_10.Vector,
    Branch06=columns_2,
    Branch07=vec_11.Vector,
    Branch08=cantiliver,
    Branch09=vec_12.Vector,
    Branch010=pointload_7,
    Branch011=multiplication,
    FlattenInputs=True)

# ----
# Model 5
number_slider_16 = Slider(-20, range=-20..20)
vec_13 = VectorXYZ(XComponent=number_slider_16, YComponent=0, ZComponent=0)  # -> Vector, Length
vec_14 = VectorXYZ(XComponent=Slider(0, range=-20..20), YComponent=0, ZComponent=0)  # -> Vector, Length
beam_4 = Curve(curve)
pointload_8 = Point(dispatch_2.ListB)
support_7 = Point(dispatch_2.ListA)

list_length_2 = ListLength(List=pointload_8)
range_5 = Range(Domain=construct_domain_2, Steps=list_length_2)
multiplication_2 = Multiplication(A=vec_7.Vector, B=range_5)

entwine_8 = Entwine(
    Branch01=beam_4,
    Branch03=support_7,
    Branch04=pointload_8,
    Branch05=vec_13.Vector,
    Branch07=vec_14.Vector,
    Branch010=pointload_8,
    Branch011=multiplication_2,
    FlattenInputs=True)

deconstruct_mesh_3 = DeconstructMesh(Mesh=ghpython_script_2.Brick)  # -> Vertices, Faces, Colours, Normals
ghpython_script_3 = GhPythonScript(x=ghpython_script_2.Brick)  # -> out, flatten(a); same code as python_2
removeduplicatepts_5 = RemoveDuplicatePts(Points=flatten(deconstruct_mesh_3.Vertices), Tolerance=0.01)
pdecon_6 = Deconstruct(Point=removeduplicatepts_5)  # -> XComponent, YComponent, ZComponent
smaller_3 = SmallerThan(FirstNumber=pdecon_6.XComponent, SecondNumber="0.1")  # -> SmallerThan, OrEqualTo
larger_than_3 = LargerThan(FirstNumber=pdecon_6.XComponent, SecondNumber=subtraction_2)  # -> LargerThan, OrEqualTo
cull_6 = CullPattern(List=removeduplicatepts_5, CullPattern=smaller_3.SmallerThan)  # -> graft(List)
cull_7 = CullPattern(List=removeduplicatepts_5, CullPattern=larger_than_3.LargerThan)  # -> graft(List)
point_4 = Point(cull_7)
pointload_9 = Point(point_4)
support_8 = Point(cull_6)
entwine_9 = Entwine(Branch03=support_8, Branch04=pointload_9, Branch05=vec_9.Vector, Branch012=ghpython_script_2.Brick, FlattenInputs=True)

dispatch_3 = Dispatch(List=removeduplicatepts_5, DispatchPattern=smaller_3.SmallerThan)  # -> ListA, ListB

point_5 = Point(dispatch_3.ListA)

stream_filter = StreamFilter(
    Gate=list,
    Stream0=entwine_7,
    Stream1=entwine_4,
    Stream2=entwine_3,
    Stream3=entwine_9,
    Stream4=entwine_2,
    Stream5=entwine_8,
    Stream6=entwine,
    Stream7=entwine_5)
explode_tree = ExplodeTree(Data=stream_filter)  # -> Branch0, Branch1, Branch2, Branch3, Branch4, Branch5, Branch6, Branch7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

pointload_10 = Point(explode_tree.Branch4)
vector = Data(explode_tree.Branch5)

support_9 = Point(explode_tree.Branch3)
shell_3 = Mesh(explode_tree.Branch0)
beam_5 = Curve(explode_tree.Branch1)
truss_2 = Curve(explode_tree.Branch2)

data_14 = Data(explode_tree.Branch6)
vector_2 = Data(explode_tree.Branch7)

data_15 = Data(explode_tree.Branch8)
vector_3 = Data(explode_tree.Branch9)

data_16 = Data(explode_tree.Branch10)
mass = Data(explode_tree.Branch11)

brick = Data(explode_tree.Branch12)

# ----
# Support
file_path_16 = FilePath("C:\GitHub\Alpaca4d\PythonScript\Pre-Processing\Element\Support\Support.py")
toggle_10 = BooleanToggle(True)
read_file_16 = ReadFile(File=file_path_16, PerLineParse=False)
point_6 = Point(support_9)
python_16 = GhPythonScript(
    Code=read_file_16,
    Pos=graft(point_6),
    Tx=toggle_10,
    Ty=Toggle(True),
    Tz=toggle_10,
    Rx=toggle_10,
    Ry=toggle_10,
    Rz=toggle_10)  # -> Out, flatten(SupportWrapper)
python_17 = GhPythonScript(x=python_16.SupportWrapper)  # -> out, a; same code as python_2
panel_20 = Panel(python_17.a)

# ----
# Linear Load
value_list = ValueList({"LocalAxis": 0, "GlobalAxis": 1}, selected="GlobalAxis")
vector_4 = Vector(vector_2)
crv = Curve(data_14)
python_18 = GhPythonScript(Code=read_file_5, Force=vector_4, Element=crv, Orientation=value_list)  # -> Out, flatten(BeamUniformLoad)

# ----
# Linear Load
value_list_2 = ValueList({"LocalAxis": 0, "GlobalAxis": 1}, selected="GlobalAxis")
vector_5 = Vector(vector_3)
crv_2 = Curve(data_15)
python_19 = GhPythonScript(Code=read_file_5, Force=vector_5, Element=crv_2, Orientation=value_list_2)  # -> Out, flatten(BeamUniformLoad)

# ----
# Point Load
file_path_17 = FilePath("C:\GitHub\Alpaca4d\PythonScript\Pre-Processing\Load\PointLoad.py")
read_file_17 = ReadFile(File=file_path_17, PerLineParse=False)
vector_6 = Vector(expr("x*0", Vector(2.518385542, -6.656153768, 0)))
vector_7 = Vector(vector)
point_7 = Point(pointload_10)
python_20 = GhPythonScript(Code=read_file_17, Force=vector_7, Moment=vector_6, Pos=point_7)  # -> Out, flatten(LoadWrapper)

# ----
# MassLoad
num_2 = Number(mass)
pt_2 = Point(data_16)
path_5 = FilePath("C:\GitHub\Alpaca4d\PythonScript\Pre-Processing\Load\MassLoad.py")
file_5 = ReadFile(File=path_5, PerLineParse=False)
python_21 = GhPythonScript(Code=file_5, NodalMass=num_2, Pos=pt_2)  # -> Out, flatten(Mass)

# ----
# meshToShell
mesh_5 = Mesh(shell_3)
file_path_18 = FilePath("C:\GitHub\Alpaca4d\PythonScript\Pre-Processing\Element\MeshToShell\MeshToShell.py")
read_file_18 = ReadFile(File=file_path_18, PerLineParse=False)
python_22 = GhPythonScript(Code=read_file_18, Mesh=mesh_5, Colour=ColourSwatch(SwatchColor=RGB(242, 19, 19)), CrossSection=python_10.CrossSection)  # -> Out, flatten(ShellWrapper)

tri = Triangulate(Mesh=mesh_5)  # -> Mesh, Count
explode_5 = MeshExplode(Mesh=mesh_5, Interpolate=False)  # -> flatten(Faces)

crv_3 = Curve(truss_2)

# ----
# LineToBeam
file_path_19 = FilePath("C:\GitHub\Alpaca4d\PythonScript\Pre-Processing\Element\LineToBeam\LineToBeam.py")
read_file_19 = ReadFile(File=file_path_19, PerLineParse=False)
crv_4 = Curve(beam_5)
python_23 = GhPythonScript(Code=read_file_19, Line=crv_4, CrossSection=python_13.CrossSection)  # -> Out, flatten(BeamWrapper)

data_17 = Data([python_18.BeamUniformLoad, python_19.BeamUniformLoad, python_20.LoadWrapper])

# ----
# LineToTruss
list_4 = ValueList({"Truss": 0, "Beam": 1}, selected="Truss")
swatch = ColourSwatch(SwatchColor=RGB(255, 200, 0))
python_24 = GhPythonScript(Code=read_file_19, Line=crv_3, CrossSection=python_8.CrossSection, OrientSection="0", BeamType=list_4)  # -> Out, flatten(BeamWrapper)

# ----
# Solid
swatch_2 = ColourSwatch(SwatchColor=RGB(0, 72, 255))
python_25 = GhPythonScript(Code=read_file_8, Brick=brick, Colour=swatch_2, NDMaterial=python_5.NDMaterial)  # -> Out, flatten(SolidWrapper)

item = ListItem(List=python_25.SolidWrapper, Index=0, Wrap=True)  # -> Item, Item1
python_26 = GhPythonScript(x=item.Item)  # -> out, simplify(a); same code as python_2
python_27 = GhPythonScript(x=python_26.a)  # -> out, simplify(a); same code as python_2
python_28 = GhPythonScript(x=python_27.a)  # -> out, simplify(a); same code as python_2
merge_9 = Merge(Data1=python_22.ShellWrapper, Data2=python_23.BeamWrapper, Data3=python_24.BeamWrapper, Data4=python_25.SolidWrapper)
panel_21 = Panel(python_28.a)
clean_tree = CleanTree(RemoveNulls=True, RemoveInvalid=True, RemoveEmpty=False, Tree=merge_9)
clean_tree_2 = CleanTree(RemoveNulls=True, RemoveInvalid=True, RemoveEmpty=False, Tree=python_16.SupportWrapper)
clean_tree_3 = CleanTree(RemoveNulls=True, RemoveInvalid=True, RemoveEmpty=False, Tree=data_17)
clean_tree_4 = CleanTree(RemoveNulls=True, RemoveInvalid=True, RemoveEmpty=False, Tree=python_21.Mass)

# ----
# Assemble
file_path_20 = FilePath("C:\GitHub\Alpaca4d\PythonScript\Pre-Processing\Assemble\Assemble.py")
read_file_20 = ReadFile(File=file_path_20, PerLineParse=False)
python_29 = GhPythonScript(
    Code=read_file_20,
    Element=flatten(clean_tree),
    Support=flatten(clean_tree_2),
    Load=flatten(clean_tree_3),
    Mass=flatten(clean_tree_4))  # -> Out, AlpacaModel, MassOfStructure

panel_22 = Panel(python_29.MassOfStructure)

# ----
# modelView
# da fare a cluster
file_path_21 = FilePath("C:\GitHub\Alpaca4d\PythonScript\Post-Processing\modelView\modelView.py")
read_file_21 = ReadFile(File=file_path_21, PerLineParse=False)
toggle_11 = BooleanToggle(False)
data_18 = Data(python_29.AlpacaModel)
python_30 = GhPythonScript(
    Code=read_file_21,
    AlpacaModel=data_18,
    LineModel=Toggle(False),
    ExtrudedModel=Toggle(False),
    Support=toggle,
    Mass=toggle,
    NodeTag=toggle_11,
    ElementTag=toggle_11)

data_19 = Data(python_29.AlpacaModel)  # disabled

# ----
# EarthQuake Analyses
path_6 = FilePath("C:\GitHub\Alpaca4d\PythonScript\Analyses\EarthQuakeAnalysis\BM68elc.acc")  # disabled
panel_23 = Panel("1")  # disabled
path_7 = FilePath("C:\GitHub\Alpaca4d\PythonScript\Analyses\EarthQuakeAnalysis\initializeEarthQuakeAnalysis.py")  # disabled
panel_24 = Panel("0.01")  # disabled
list_5 = ValueList({"x": 1, "y": 2, "z": 3}, selected="x")  # disabled
panel_25 = Panel("7")  # disabled
file_6 = ReadFile(File=path_7, PerLineParse=False)  # disabled
analyze_2 = GhPythonScript(
    Code=file_6,
    AlpacaModel=data_19,
    TmaxAnalyses=panel_25,
    GroundMotionDirection=list_5,
    GroundMotionValues=sine,
    GroundMotionTimeStep=series_3,
    GroundMotionFactor=panel_23,
    TimeStepIncrement=panel_17,
    Damping=panel_19,
    NewmarkGamma=0.5,
    NewmarkBeta=0.25)  # -> Out, AlpacaGroundmotionOutput, MaxDisplacement, MinDisplacement; disabled

file_7 = ReadFile(File=path_6, PerLineParse=False)  # disabled
graph_2 = QuickGraph(sine, SortOrder=0)  # disabled
panel_26 = Panel(" ")  # disabled
split = TextSplit(Text=file_7, Separators=panel_26)  # disabled
panel_27 = Panel("1")  # disabled
division = Division(A=split, B=panel_27)  # disabled
clean_3 = CleanTree(RemoveNulls=True, RemoveInvalid=True, RemoveEmpty=invert(False), Tree=division)  # disabled
lng = ListLength(List=clean_3)  # disabled
multiplication_3 = Multiplication(A=lng, B=panel_24)  # disabled
earthquake_file_seconds = Panel(multiplication_3)  # disabled

analyze_3 = GhPythonScript(Code=file, AlpacaModel=python_29.AlpacaModel)  # -> Out, AlpacaStaticOutput, MaxDisplacement
analyze_4 = GhPythonScript(Code=file_2, AlpacaModel=python_29.AlpacaModel)  # -> Out, AlpacaStaticOutput; disabled
series_6 = Series(Start=0, Step=panel_24, Count=lng)  # disabled
geometry = Geometry(python_30)
panel_28 = Panel(analyze_2.MinDisplacement)  # disabled
panel_29 = Panel(analyze_2.MaxDisplacement)  # disabled
panel_30 = Panel(analyze_2.AlpacaGroundmotionOutput)  # disabled
analyze_5 = GhPythonScript(
    AlpacaModel=data_19,
    TmaxAnalyses=panel_25,
    GroundMotionDirection=list_5,
    GroundMotionValues=sine,
    GroundMotionTimeStep=series_3,
    GroundMotionFactor=panel_23,
    TimeStepIncrement=panel_17,
    Damping=0.02,
    NewmarkGamma=0.5,
    NewmarkBeta=0.25)  # -> out, AlpacaGroundmotionOutput, maxDisplacement, minDisplacement; inputs AlpacaModel: list, GroundMotionDirection: Int32, GroundMotionValues: list, GroundMotionTimeStep: list; disabled
# ---------- analyze_5: Python ----------
"""Calculate the Static Response of the structure
    Inputs:
        AlpacaModel: Assembled model to perform Static Analyses.
        TmaxAnalyses: Time Frame where the structure will be analyse
        GroundMotionDirection: Direction of the earthQuake. 1 = X, 2 = Y, 3 = Z
        GroundMotionValues: Acceleration values for each time step
        GroundMotionTimeStep: time step for each acceleration value
        GroundMotionFactor: Multiplier of the GroundMotionValues
        TimeStepIncrement: integration step size. Recomended value is 0.1 times the time step
        Damping: Damping value. Default is 0.02
        NewmarkGamma: Gamma value to implement the Newmark integrator. Default is 0.5
        NewmarkBeta: Beta value to implement the Newmark integrator. Default is 0.25
    Output:
       AlpacaGroundMotionOutput: Analysed Alpaca model.
       maxDisplacement: Maximum displacement of structure [mm].
       minDisplacement: Minimum displacement of structure [mm].
       """


import System
import os
import Grasshopper as gh

def InitializeGroundMotionAnalysis(AlpacaModel, TmaxAnalyses, GroundMotionDirection, GroundMotionValues, GroundMotionTimeStep, GroundMotionFactor, TimeStepIncrement, Damping, NewmarkGamma, NewmarkBeta):
    ghFilePath = ghenv.Component.Attributes.Owner.OnPingDocument().FilePath

    # delete file if already there
    workingDirectory = os.path.dirname(ghFilePath) 
    outputFileName = 'openSeesEarthQuakeAnalysisOutputWrapper.txt'

    for dirpath, dirnames, filenames in os.walk(workingDirectory):
        for filename in filenames:
            print(filename)
            if filename == outputFileName:
                file = os.path.join(dirpath,outputFileName)
                os.remove(file)


    ghFolderPath = os.path.dirname(ghFilePath)
    outputFolder = os.path.join(ghFolderPath,'assembleData')
    wrapperFile = os.path.join( outputFolder,'openSeesModel.txt' )
    
    GroundMotionFactor = 1 if GroundMotionFactor is None else GroundMotionFactor
    Damping = 0.02 if Damping is None else Damping
    NewmarkGamma = 0.5 if NewmarkGamma is None else NewmarkGamma
    NewmarkBeta = 0.25 if NewmarkBeta is None else NewmarkBeta
    
    earthQuakeSettings = []

    for item in GroundMotionValues:
        earthQuakeSettings.append( "GROUNDMOTIONVALUES {}".format(item) )

    for item in GroundMotionTimeStep:
        earthQuakeSettings.append( "GROUNDMOTIONTIMESTEP {}".format(item) )

    earthQuakeSettings.append( "GROUNDMOTIONDIRECTION {}".format(GroundMotionDirection) )
    earthQuakeSettings.append( "GROUNDMOTIONFACTOR {}".format(GroundMotionFactor) )
    earthQuakeSettings.append( "DAMPING {}".format(Damping) )
    earthQuakeSettings.append( "NEWMARKGAMMA {}".format(NewmarkGamma) )
    earthQuakeSettings.append( "NEWMARKBETA {}".format(NewmarkBeta) )
    earthQuakeSettings.append( "TMAXANALYSES {}".format(TmaxAnalyses) )
    earthQuakeSettings.append( "TIMESTEP {}".format(TimeStepIncrement) )


    earthQuakeSettingsFile = os.path.join( outputFolder,'earthQuakeSettingsFile.txt')

    with open(earthQuakeSettingsFile, 'w') as f:
        for item in earthQuakeSettings:
            f.write("%s\n" % item)


    userObjectFolder = gh.Folders.DefaultUserObjectFolder
    pythonInterpreter = os.path.join(userObjectFolder, r'Alpaca4d\Analyses\WPy64\python-3.7.7.amd64\python.exe')
    #pythonInterpreter = os.path.join(userObjectFolder, r'Alpaca4d\Analyses\WPy64\scripts\winpython.bat')
    fileName = os.path.join(userObjectFolder, r'Alpaca4d\Analyses\EarthQuakeAnalysis\openSees_EarthQuakeAnalysis.py')


    fileName = '"' + fileName + '"'
    wrapperFile = '"' + wrapperFile + '"'
    earthQuakeSettingsFile = '"' + earthQuakeSettingsFile + '"'
    
    p = System.Diagnostics.Process()
    p.StartInfo.RedirectStandardOutput = False
    p.StartInfo.RedirectStandardError = False

    p.StartInfo.UseShellExecute = True
    p.StartInfo.CreateNoWindow = True
    
    p.StartInfo.FileName = pythonInterpreter
    p.StartInfo.Arguments = fileName + " " + wrapperFile + " " + earthQuakeSettingsFile
    p.Start()
    p.WaitForExit()
    
    
    #msg = p.StandardError.ReadToEnd()
    #ghenv.Component.AddRuntimeMessage(gh.Kernel.GH_RuntimeMessageLevel.Error, msg)

    print("I have finished")

    ## READ THE OUTPUT FROM THE OPEENSEES_SOLVER
    ## THE ORDER MUST BE THE SAME OF THE OUTPUT LIST IN OpenSeesStaticSolver.py


    outputFile = os.path.join(outputFolder, outputFileName)

    with open(outputFile, 'r') as f:
        lines = f.readlines()
        nodeDispFilePath = lines[0].strip()
        elementModalWrapper = eval( lines[1].strip() )
        nodeWrapper = eval( lines[2].strip() )
        maxDisplacement = lines[3]
        minDisplacement = lines[4]


    AlpacaGroundmotionOutput = [nodeDispFilePath, elementModalWrapper, nodeWrapper]

    return [AlpacaGroundmotionOutput, maxDisplacement, minDisplacement]

checkData = True

if not AlpacaModel:
    checkData = False
    msg = "input 'AlpacaModel' failed to collect data"
    ghenv.Component.AddRuntimeMessage(gh.Kernel.GH_RuntimeMessageLevel.Warning, msg)

if TmaxAnalyses is None:
    checkData = False
    msg = "input 'TmaxAnalyses' failed to collect data"
    ghenv.Component.AddRuntimeMessage(gh.Kernel.GH_RuntimeMessageLevel.Warning, msg)

if GroundMotionDirection is None:
    checkData = False
    msg = "input 'GroundMotionDirection' failed to collect data"
    ghenv.Component.AddRuntimeMessage(gh.Kernel.GH_RuntimeMessageLevel.Warning, msg)


if not GroundMotionValues:
    checkData = False
    msg = "input 'GroundMotionValues' failed to collect data"
    ghenv.Component.AddRuntimeMessage(gh.Kernel.GH_RuntimeMessageLevel.Warning, msg)


if not GroundMotionTimeStep:
    checkData = False
    msg = "input 'GroundMotionTimeStep' failed to collect data"
    ghenv.Component.AddRuntimeMessage(gh.Kernel.GH_RuntimeMessageLevel.Warning, msg)


if GroundMotionFactor is None:
    checkData = False
    msg = "input 'GroundMotionFactor' failed to collect data"
    ghenv.Component.AddRuntimeMessage(gh.Kernel.GH_RuntimeMessageLevel.Warning, msg)


if TimeStepIncrement is None:
    checkData = False
    msg = "input 'TimeStepIncrement' failed to collect data"
    ghenv.Component.AddRuntimeMessage(gh.Kernel.GH_RuntimeMessageLevel.Warning, msg)


if Damping is None:
    checkData = False
    msg = "input 'Damping' failed to collect data"
    ghenv.Component.AddRuntimeMessage(gh.Kernel.GH_RuntimeMessageLevel.Warning, msg)

if NewmarkGamma is None:
    checkData = False
    msg = "input 'NewmarkGamma' failed to collect data"
    ghenv.Component.AddRuntimeMessage(gh.Kernel.GH_RuntimeMessageLevel.Warning, msg)

if NewmarkBeta is None:
    checkData = False
    msg = "input 'NewmarkBeta' failed to collect data"
    ghenv.Component.AddRuntimeMessage(gh.Kernel.GH_RuntimeMessageLevel.Warning, msg)


if checkData != False:
    AlpacaGroundmotionOutput, maxDisplacement, minDisplacement = InitializeGroundMotionAnalysis(AlpacaModel, TmaxAnalyses, GroundMotionDirection, GroundMotionValues, GroundMotionTimeStep, GroundMotionFactor, TimeStepIncrement, Damping, NewmarkGamma, NewmarkBeta)
# ---------- end analyze_5 ----------
data_20 = Data(python_29.AlpacaModel)  # disabled

# ----
# Modal Analyses
path_8 = FilePath("C:\GitHub\Alpaca4d\PythonScript\Analyses\DynamicAnalysis\initializeModalAnalyses.py")  # disabled
panel_31 = Panel("3")  # disabled
file_8 = ReadFile(File=path_8, PerLineParse=False)  # disabled
analyze_6 = GhPythonScript(Code=file_8, AlpacaModel=data_20, NumVibrationModes=panel_31)  # -> Out, AlpacaModalOutput, Frequency, Period; disabled

merge_10 = Merge(Data1=analyze_3.AlpacaStaticOutput, Data2=analyze_4.AlpacaStaticOutput)  # -> flatten(Result); disabled

# ---- group: Reaction Forces
# Reactions
number_slider_17 = Slider(10, range=0..100)  # disabled
file_path_22 = FilePath("C:\GitHub\Alpaca4d\PythonScript\Post-Processing\reaction\reaction.py")  # disabled
toggle_12 = BooleanToggle(True)  # disabled
read_file_22 = ReadFile(File=file_path_22, PerLineParse=False)  # disabled
toggle_13 = BooleanToggle(True)  # disabled
python_31 = GhPythonScript(
    Code=read_file_22,
    AlpacaStaticOutput=analyze_3.AlpacaStaticOutput,
    ReactionForcesView=toggle_13,
    ReactionMomentsView=toggle_12,
    Scale=number_slider_17)  # -> Out, TagPoints, ReactionForce, ReactionMoment, View; disabled
reactionforce = ReactionForce(python_31.ReactionForce)  # disabled
tagpoints = TagPoints(python_31.TagPoints)  # disabled
reactionmoment = ReactionMoment(python_31.ReactionMoment)  # disabled
explode_tree_2 = ExplodeTree(Data=python_31.View)  # -> Branch0, Branch1, Branch2, Branch3, Branch4, Branch5, Branch6; disabled
colour_swatch_23 = ColourSwatch(SwatchColor=RGB(252, 0, 0))  # disabled
colour_swatch_24 = ColourSwatch(SwatchColor=RGB(0, 55, 255))  # disabled
vector_display_ex = VectorDisplayEx(
    Point=explode_tree_2.Branch0,
    Vector=[explode_tree_2.Branch3, explode_tree_2.Branch2, explode_tree_2.Branch1],
    Colour=colour_swatch_23,
    Width=2)  # disabled
vector_display_ex_2 = VectorDisplayEx(
    Point=explode_tree_2.Branch0,
    Vector=[explode_tree_2.Branch6, explode_tree_2.Branch5, explode_tree_2.Branch4],
    Colour=colour_swatch_24,
    Width=2)  # disabled

# ----
merge_11 = Merge(Data1=analyze_3.AlpacaStaticOutput, Data2=analyze_4.AlpacaStaticOutput)  # -> flatten(Result)

# ---- group: Beam Forces
# CDS valor
number_slider_18 = Slider(10, range=0..10)  # disabled
file_path_23 = FilePath("C:\GitHub\Alpaca4d\PythonScript\Post-Processing\beamForces\beamForces.py")  # disabled
# beam Component
read_file_23 = ReadFile(File=file_path_23, PerLineParse=False)  # disabled
python_32 = GhPythonScript(Code=read_file_23, AlpacaStaticOutput=analyze_3.AlpacaStaticOutput)  # -> Out, TagElement, N, V1, V2, Mt, M1, M2; disabled

# ---- group: Cds Visualisation
# CDS view
number_slider_19 = Slider(1.412, range=0.001..10)
file_path_24 = FilePath("C:\GitHub\Alpaca4d\PythonScript\Post-Processing\cdsView\cdsView.py")
read_file_24 = ReadFile(File=file_path_24, PerLineParse=False)
list_6 = ValueList({"N", "V1", "V2", "M2", "M1", "Mt"}, selected="N")
python_33 = GhPythonScript(Code=read_file_24, AlpacaStaticOutput=analyze_3.AlpacaStaticOutput, SectionForces=list_6)

# ---- group: shell Forces
# Forces valor
file_path_25 = FilePath("C:\GitHub\Alpaca4d\PythonScript\Post-Processing\shellForces\shellForces.py")  # disabled
read_file_25 = ReadFile(File=file_path_25, PerLineParse=False)  # disabled
python_34 = GhPythonScript(Code=read_file_25, AlpacaStaticOutput=analyze_3.AlpacaStaticOutput)  # -> Out, TagElement, Fx, Fy, Fz, Mx, My, Mz; disabled

# ---- group: nD Stress Visualisation
# Stress view & valor
file_path_26 = FilePath("C:\GitHub\Alpaca4d\PythonScript\Post-Processing\brickStress\brickStress.py")  # disabled
read_file_26 = ReadFile(File=file_path_26, PerLineParse=False)  # disabled
list_7 = ValueList({"sigmaX": 0, "sigmaY": 1, "sigmaZ": 2, "tauXY": 3, "tauXZ": 4, "tauYZ": 5}, selected="tauYZ")  # disabled
# Brick component
python_35 = GhPythonScript(Code=read_file_26, AlpacaStaticOutput=analyze_4.AlpacaStaticOutput, StressView=list_7)  # -> Brick, StressValue; disabled
# da riguardare per i valori
cluster = Cluster_2(mesh=python_35.Brick, list=python_35.StressValue, index=0)  # disabled

# ----
# Forces view
file_path_27 = FilePath("C:\GitHub\Alpaca4d\PythonScript\Post-Processing\shellForceView\shellForceView.py")
read_file_27 = ReadFile(File=file_path_27, PerLineParse=False)
list_8 = ValueList({"Face1": 0, "Face2": 1, "Face3": 2, "Face4": 3}, selected="Face1")
list_9 = ValueList({"Fx": 0, "Fy": 1, "Fz": 2, "Mx": 3, "My": 4, "Mz": 5}, selected="Fx")
python_36 = GhPythonScript(Code=read_file_27, AlpacaStaticOutput=analyze_3.AlpacaStaticOutput, ViewForce=list_9)  # -> Shell, ForceValue
cluster_2 = Cluster_2(mesh=python_36.Shell, list=python_36.ForceValue, index=list_8)

# ---- group: Shell Stress Visualisation
# Stress view & valor
file_path_28 = FilePath("C:\GitHub\Alpaca4d\PythonScript\Post-Processing\shellStressView\shellStressView.py")
read_file_28 = ReadFile(File=file_path_28, PerLineParse=False)
list_10 = ValueList({"pxx": 0, "pyy": 1, "pxy": 2, "txz": 3, "tyz": 4, "mxx": 5, "myy": 6, "mxy": 7}, selected="tyz")
python_37 = GhPythonScript(Code=read_file_28, AlpacaStaticOutput=analyze_3.AlpacaStaticOutput, StressView=list_10, ColorList=merge_2)  # -> Shell, StressValue, DomainValues

# ----
ghpython_script_4 = GhPythonScript(Code=file_3, AlpacaGroundmotionOutput=analyze_2.AlpacaGroundmotionOutput, Animate=toggle_5)  # -> Out, ModelDisp, ModelCurve, ModelShell, ModelSolid, Trans; disabled
pdecon_7 = Deconstruct(Point=ghpython_script_4.Trans)  # -> XComponent, YComponent, ZComponent; disabled
graph_3 = QuickGraph(pdecon_7.XComponent, SortOrder=0)  # disabled

# ----
# deformedModelView
# OK!
number_slider_20 = Slider(496, range=0..10000)
file_path_29 = FilePath("C:\GitHub\Alpaca4d\PythonScript\Post-Processing\defModelView\defModelView.py")
read_file_29 = ReadFile(File=file_path_29, PerLineParse=False)
list_11 = ValueList({"tx": 0, "ty": 1, "tz": 2, "txyz": 3}, selected="tz")
python_38 = GhPythonScript(
    Code=read_file_29,
    AlpacaStaticOutput=merge_11,
    Scale=number_slider_20,
    ModelExstrud=Toggle(False),
    Direction=list_11,
    ColorList=merge_5)  # -> Out, ModelDisp, DomainValues
panel_32 = Panel(merge_5)
panel_33 = Panel(python_38.ModelDisp)
# displacement Component
cluster_3 = Cluster(gate=0)

# ---- group: MODAL ANALYSIS
ghpython_script_5 = GhPythonScript(
    Code=file_4,
    AlpacaModalOutput=analyze_6.AlpacaModalOutput,
    NumberMode=number_slider_9,
    Speed=number_slider_10,
    Visualise=toggle_8,
    Animate=toggle_7,
    Reset=button_2,
    Scale=number_slider_11,
    Direction=list_2,
    ModelExstrud=toggle_6,
    ColorList=merge_4)  # -> Out, ModelDisp, DomainValues; disabled

# ---- group: brick Displacement
python_39 = GhPythonScript(Code=read_file_14, AlpacaStaticOutput=analyze_4.AlpacaStaticOutput)  # -> Out, TagElement, Trans; disabled

# ---- group: Shell Displacement
python_40 = GhPythonScript(Code=read_file_12, AlpacaStaticOutput=analyze_3.AlpacaStaticOutput)  # -> Out, TagElement, Trans, Rot; disabled

# ---- group: Beam Displacement
python_41 = GhPythonScript(Code=read_file_11, AlpacaStaticOutput=analyze_3.AlpacaStaticOutput, NumberResults=number_slider_12)  # -> Out, TagElement, LocalTrans, LocalRot, GlobalTrans, GlobalRot; disabled

# ---- group: NodeDisp
python_42 = GhPythonScript(Code=read_file_13, AlpacaStaticOutput=merge_10)  # -> Out, Points, Trans, Rot; disabled

# ----
# shell Component
panel_34 = Panel(python_34.Mz)  # disabled

# ----
# OK!
file_path_30 = FilePath("C:\GitHub\Alpaca4d\PythonScript\Post-Processing\disassembleModel\disassembleModel.py")
read_file_30 = ReadFile(File=file_path_30, PerLineParse=False)

# ---- group: disassemble Model
python_43 = GhPythonScript(Code=read_file_30, AlpacaModel=python_29.AlpacaModel)  # -> Element, ExtrudedElement, Points, Support, Load, Material, Section

# ----
panel_35 = Panel(python_43.ExtrudedElement)

# ==== cluster Cluster
tree = ClusterInput()
tree_2 = ClusterInput()
gate = ClusterInput()
tree_3 = ClusterInput()
tree_statistics = TreeStatistics(Tree=tree_2)  # -> Paths, Length, Count
tree_statistics_2 = TreeStatistics(Tree=tree)  # -> Paths, Length, Count
cull_index = CullIndex(List=tree_statistics.Paths, Indices="0", Wrap=True)
tree_statistics_3 = TreeStatistics(Tree=tree_3)  # -> Paths, Length, Count
construct_path = ConstructPath(Indices="0")
cull_index_2 = CullIndex(List=tree_statistics_2.Paths, Indices="0", Wrap=True)
construct_path_2 = ConstructPath(Indices="0")
cull_index_3 = CullIndex(List=tree_statistics_3.Paths, Indices="0", Wrap=True)
tree_branch = TreeBranch(Tree=tree_2, Path=construct_path, MaintainPaths=True)
tree_branch_2 = TreeBranch(Tree=tree_2, Path=cull_index, MaintainPaths=True)
construct_path_3 = ConstructPath(Indices="0")
tree_branch_3 = TreeBranch(Tree=tree, Path=construct_path_2, MaintainPaths=True)
tree_branch_4 = TreeBranch(Tree=tree, Path=cull_index_2, MaintainPaths=True)
list_length = ListLength(List=tree_branch_2)
tree_branch_5 = TreeBranch(Tree=tree_3, Path=construct_path_3, MaintainPaths=True)
tree_branch_6 = TreeBranch(Tree=tree_3, Path=cull_index_3, MaintainPaths=True)
deconstruct_vector = DeconstructVector(Vector=tree_branch_4)  # -> XComponent, YComponent, ZComponent
vector_length = VectorLength(Vector=tree_branch_4)
divide_curve = DivideCurve(Curve=tree_branch, Count=flatten(list_length), Kinks=False)  # -> Points, Tangents, simplify(Parameters)
deconstruct_vector_2 = DeconstructVector(Vector=tree_branch_6)  # -> XComponent, YComponent, ZComponent
vector_length_2 = VectorLength(Vector=tree_branch_6)
stream_filter = StreamFilter(
    Gate=gate,
    Stream0=deconstruct_vector.XComponent,
    Stream1=deconstruct_vector.YComponent,
    Stream2=deconstruct_vector.ZComponent,
    Stream3=vector_length)
stream_filter_2 = StreamFilter(
    Gate=gate,
    Stream0=deconstruct_vector_2.XComponent,
    Stream1=deconstruct_vector_2.YComponent,
    Stream2=deconstruct_vector_2.ZComponent,
    Stream3=vector_length_2)
deconstruct_vector_3 = DeconstructVector(Vector=tree_branch_2)  # -> XComponent, YComponent, ZComponent
vector_length_3 = VectorLength(Vector=tree_branch_2)
merge = Merge(Data1=tree_branch_2, Data2=tree_branch_4, Data3=tree_branch_6)  # -> flatten(Result)
deconstruct_vector_4 = DeconstructVector(Vector=merge)  # -> XComponent, YComponent, ZComponent
stream_filter_3 = StreamFilter(
    Gate=gate,
    Stream0=deconstruct_vector_3.XComponent,
    Stream1=deconstruct_vector_3.YComponent,
    Stream2=deconstruct_vector_3.ZComponent,
    Stream3=vector_length_3)
vector_length_4 = VectorLength(Vector=merge)
stream_filter_4 = StreamFilter(
    Gate=gate,
    Stream0=deconstruct_vector_4.XComponent,
    Stream1=deconstruct_vector_4.YComponent,
    Stream2=deconstruct_vector_4.ZComponent,
    Stream3=vector_length_4)
bounds = Bounds(Numbers=flatten(stream_filter_4))
entwine = Entwine(Branch00=stream_filter_3, Branch01=stream_filter, Branch02=stream_filter_2, FlattenInputs=True)  # -> flatten(Result)
deconstruct_domain = DeconstructDomain(Domain=bounds)  # -> Start, End
bounds_2 = Bounds(Numbers=entwine)
shatter = Shatter(Curve=graft(tree_branch), Parameters=divide_curve.Parameters)  # -> simplify(graft(Segments))
domain = ClusterOutput(bounds_2)
gradient = Gradient(
    LowerLimit=deconstruct_domain.Start,
    UpperLimit=deconstruct_domain.End,
    Parameter=stream_filter_3,
    stops=[0.103: RGB(0, 0, 255), 0.22: RGB(0, 170, 255), 0.305: RGB(0, 255, 255), 0.398: RGB(0, 255, 188), 0.504: RGB(0, 255, 106), 0.605: RGB(91, 255, 0), 0.699: RGB(184, 255, 0), 0.799: RGB(255, 255, 0), 0.898: RGB(255, 170, 0)])
gradient_2 = Gradient(
    LowerLimit=deconstruct_domain.Start,
    UpperLimit=deconstruct_domain.End,
    Parameter=stream_filter,
    stops=[0.103: RGB(0, 0, 255), 0.22: RGB(0, 170, 255), 0.305: RGB(0, 255, 255), 0.398: RGB(0, 255, 188), 0.504: RGB(0, 255, 106), 0.605: RGB(91, 255, 0), 0.699: RGB(184, 255, 0), 0.799: RGB(255, 255, 0), 0.898: RGB(255, 170, 0)])
gradient_3 = Gradient(
    LowerLimit=deconstruct_domain.Start,
    UpperLimit=deconstruct_domain.End,
    Parameter=stream_filter_2,
    stops=[0.103: RGB(0, 0, 255), 0.22: RGB(0, 170, 255), 0.305: RGB(0, 255, 255), 0.398: RGB(0, 255, 188), 0.504: RGB(0, 255, 106), 0.605: RGB(91, 255, 0), 0.699: RGB(184, 255, 0), 0.799: RGB(255, 255, 0), 0.898: RGB(255, 170, 0)])
number_slider = Slider(3, range=0..10)
curve = Curve(flatten(shatter))
mesh_colours = MeshColours(Mesh=graft(tree_branch_5), Colours=gradient_3)
mesh_colours_2 = MeshColours(Mesh=graft(tree_branch_3), Colours=gradient_2)
custom_preview = CustomPreview(Geometry=curve, Material=flatten(gradient))

# ==== cluster Cluster_2
index = ClusterInput()
list = ClusterInput()
list_item = ListItem(List=list, Index=index, Wrap=True)
bounds = Bounds(Numbers=flatten(list_item))
deconstruct_domain = DeconstructDomain(Domain=bounds)  # -> Start, End
gradient = Gradient(
    LowerLimit=deconstruct_domain.Start,
    UpperLimit=deconstruct_domain.End,
    Parameter=list_item,
    stops=[0.103: RGB(0, 0, 255), 0.22: RGB(0, 170, 255), 0.305: RGB(0, 255, 255), 0.398: RGB(0, 255, 188), 0.504: RGB(0, 255, 106), 0.605: RGB(91, 255, 0), 0.699: RGB(184, 255, 0), 0.799: RGB(255, 255, 0), 0.898: RGB(255, 170, 0)])
mesh = ClusterInput()
mesh_colours = MeshColours(Mesh=graft(mesh), Colours=gradient)
