# Grasshopper definition timberDesign.gh (Grasshopper 1.0.7)

value_list = ValueList({"C14", "C16", "C18", "C20", "C22", "C24"}, selected="C16")
tp = TimberPropertiesC16Alpaca4d(TimberClass=value_list)  # -> out, timber_attributes
# ---------- tp: Python ----------
"""
Create a uniaxial Elastic Material
-
    Args:
        E:
        Eneg:
        eta:
        G:
        v:
        rho:
    Returns:
        uniAxialMaterial:
"""


import os
import sys
import Rhino.Geometry as rg
import Grasshopper as gh
import copy
import json



ghenv.Component.Name = "Timber Properties {} (Alpaca4d)".format(TimberClass)
ghenv.Component.NickName = 'TP'
ghenv.Component.Message = "Timber Properties {} (Alpaca4d)".format(TimberClass)




## add alpaca install directory to system path

ghcompfolder = gh.Folders.DefaultAssemblyFolder
if ghcompfolder not in sys.path:
    sys.path.append(ghcompfolder)

try:
    from Alpaca4d import alpaca4d as alpaca
except:
    msg = "Cannot import Alpaca4d. Is the Alpaca4d folder available in " + ghcompfolder + "?"
    ghenv.Component.AddRuntimeMessage(gh.Kernel.GH_RuntimeMessageLevel.Error, msg)


timber_library = os.path.join(ghcompfolder,'Alpaca4d/Material/timber_properties.json')


class Struct:
    def __init__(self, **entries):
        self.__dict__.update(entries)
    
    def __repr__(self):
        return str(self.__dict__)




# Opening JSON 
with open(timber_library, 'r') as json_file:
    timber_properties = json.load(json_file)

#TimberClass = 'C16' if TimberClass is None else TimberClass


if fc_0_k:
    timber_properties[TimberClass]['fc_0_k'] = fc_0_k
if fm_k:
    timber_properties[TimberClass]['fm_k'] = fm_k
if fc_90_k:
    timber_properties[TimberClass]['fc_90_k'] = fc_90_k
if ft_0_k:
    timber_properties[TimberClass]['ft_0_k'] = ft_0_k
if ft_90_k:
    timber_properties[TimberClass]['ft_90_k'] = ft_90_k
if fv_k:
    timber_properties[TimberClass]['fv_k'] = fv_k

if E0_05:
    timber_properties[TimberClass]['E0_05'] = E0_05
if G_Mean:
    timber_properties[TimberClass]['G_Mean'] = G_Mean

timber_properties[TimberClass]['name'] = TimberClass
timber_properties[TimberClass]['material_type'] = 'timber'




for k,v in timber_properties[TimberClass].items():
    print("{}: {}".format(k,v))



timber_attributes = Struct(**timber_properties[TimberClass])
# ---------- end tp ----------

panel = Panel(tp.out)
uem = UniaxialElasticMaterialAlpaca4d(E="210000", v="0.30", rho="400", attributes=tp.timber_attributes)  # -> out, uniAxialMaterial
# ---------- uem: Python ----------
"""
Create a uniaxial Elastic Material
-
    Args:
        E:
        Eneg:
        eta:
        G:
        v:
        rho:
    Returns:
        uniAxialMaterial:
"""

ghenv.Component.Name = "uniaxial Elastic Material (Alpaca4d)"
ghenv.Component.NickName = 'UEM'
ghenv.Component.Message = "uniaxial Elastic (Alpaca4d)"

import sys
import Rhino.Geometry as rg
import Grasshopper as gh
import copy


## add alpaca install directory to system path

ghcompfolder = gh.Folders.DefaultAssemblyFolder
if ghcompfolder not in sys.path:
    sys.path.append(ghcompfolder)

try:
    from Alpaca4d import alpaca4d as alpaca
except:
    msg = "Cannot import Alpaca4d. Is the Alpaca4d folder available in " + ghcompfolder + "?"
    ghenv.Component.AddRuntimeMessage(gh.Kernel.GH_RuntimeMessageLevel.Error, msg)


checkData = True

if not E:
    checkData = False
    msg = "Input parameter E failed to collect data"
    ghenv.Component.AddRuntimeMessage(gh.Kernel.GH_RuntimeMessageLevel.Warning, msg)

if not G and not v:
    checkData = False
    msg = "Input parameter G or v failed to collect data"
    ghenv.Component.AddRuntimeMessage(gh.Kernel.GH_RuntimeMessageLevel.Warning, msg)

if not rho:
    checkData = False
    msg = "Input parameter rho failed to collect data"
    ghenv.Component.AddRuntimeMessage(gh.Kernel.GH_RuntimeMessageLevel.Warning, msg)



if checkData:
    uniAxialMaterial = alpaca.uniAxialMaterialElastic(name, E, Eneg, eta, G, v, rho, attributes)
# ---------- end uem ----------
ghpython_script = GhPythonScript()  # -> out, timber_properties
# ---------- ghpython_script: Python ----------
import sys
import Rhino.Geometry as rg
import Grasshopper as gh
import copy


## add alpaca install directory to system path

ghcompfolder = gh.Folders.DefaultAssemblyFolder
if ghcompfolder not in sys.path:
    sys.path.append(ghcompfolder)

try:
    from Alpaca4d import alpaca4d as alpaca
except:
    msg = "Cannot import Alpaca4d. Is the Alpaca4d folder available in " + ghcompfolder + "?"
    ghenv.Component.AddRuntimeMessage(gh.Kernel.GH_RuntimeMessageLevel.Error, msg)



# importing the module
import json
from Alpaca4d.bunch import Bunch

# Opening JSON file
with open(r"C:\Users\Marco\Desktop\timber_properties.json", 'r') as json_file:
    timberProperties = json.load(json_file)


timber_properties = timberProperties[Timber_Class]


for k,v in timber_properties.items():
    print("{}: {}".format(k,v))
# ---------- end ghpython_script ----------
panel_2 = Panel(uem.uniAxialMaterial)
panel_3 = Panel(ghpython_script.out)
